# Grasshopper definition full_mockup.gh (Grasshopper 0.9.76)
# plug-ins: Python Interpreter

number_slider = Slider(10, range=0..10)
rectangle = Rectangle(Plane=PlaneXY(0, 0, 0), XSize=Domain(-1, 1), YSize=Domain(-2, 2), Radius=0)  # -> Rectangle, Length
mesh_uv = MeshSurface(Surface=rectangle.Rectangle, UCount=5, VCount=5, Overhang=True, Equalize=False)
data = Data()
anchor_points = AnchorPoints()
formdiagram = FormDiagram()
random = Random(Range=Domain(0, 1), Number=number_slider, Seed=1)
random_2 = Random(Range=Domain(0, 1), Number=number_slider, Seed=0)
random_3 = Random(Range=Domain(0, 1), Number=number_slider, Seed=2)
python = PythonScript()  # -> form, force
# ---------- python: Python ----------
from compas_tna.diagrams import FormDiagram
from compas_tna.diagrams import ForceDiagram

_form = FormDiagram.from_json('C:/Users/Kam-Ming Mark Tam/Documents/GitHub/AAG2018/AAG2018/src/day_1/final/aag_02_formdiagram.json')
_force = ForceDiagram.from_json('C:/Users/Kam-Ming Mark Tam/Documents/GitHub/AAG2018/AAG2018/src/day_1/final/aag_03_forcediagram.json')

form = _form
force = _force

_form.set_edges_attribute('fmin', 0.2)
_form.set_edges_attribute('fmax', 5.0)
# ---------- end python ----------

# ---- group: Proxy Reset
python_2 = PythonScript()  # -> out, a
# ---------- python_2: Python ----------
from compas.rpc import Proxy
compas_tna = Proxy('compas_ghc.tna')
compas_tna.stop_server()
compas_tna = Proxy('compas_ghc.tna')
# ---------- end python_2 ----------

# ----
mesh = Mesh(mesh_uv)
formdiagram_2 = FormDiagram()
forcediagram = ForceDiagram()
data_2 = Data(data)
data_3 = Data(anchor_points)
data_4 = Data(python.form)
data_5 = Data(formdiagram)
pt = ConstructPoint(XCoordinate=random_3, YCoordinate=random, ZCoordinate=random_2)
cluster = Cluster_5(mesh=mesh)
cluster_2 = Cluster_6(diagram=cluster)
pt_2 = Point(pt)
input = ClusterInput()
mesh_2 = Mesh(cluster_2)
python_3 = PythonScript()  # -> Out, A

# ---- group: Γ
data_6 = Data(data_4)

# ----
python_4 = PythonScript()  # -> out, guid
# ---------- python_4: Python ----------
from compas_pattern.cad.rhino.utilities import draw_mesh

guid = draw_mesh(quad_mesh_datastructure, group = False)
# ---------- end python_4 ----------
assemblestructuraldesign = AssembleStructuralDesign(formdiagram=data_6)
vec = VectorXYZ(XComponent=0, YComponent=0, ZComponent=0)  # -> Vector, Length
assemblestructuraldesign_2 = AssembleStructuralDesign_2()
createloads = CreateLoads()

# ---- group: structDsg
data_7 = Data(assemblestructuraldesign)

# ---- group: DisassembleStructuralDesign
cluster_3 = Cluster_2()  # -> structuraldesign_1, forcediagram_1

# ----
data_8 = Data(createloads)
loads = Loads()

# ---- group: CreateDualDiagram
cluster_4 = Cluster(structuraldesign_0=data_7)  # -> structuraldesign_1, forcediagram_1

# ----
anchor_points_2 = AnchorPoints()
pt_3 = Point([<point referenced from the Rhino model> x4])
formdiagram_3 = FormDiagram()
loads_2 = Loads()
number_slider_2 = Slider(100, range=0..100)
number_slider_3 = Slider(100, range=0..100)
data_9 = Data(formdiagram_3)
data_10 = Data(pt_3)
data_11 = Data(data_8)

# ---- group: structDsg
data_12 = Data(cluster_4.structuraldesign_1)

# ----
int = Integer()
int_2 = Integer()

# ---- group: HorizontalEquilibrium
cluster_5 = Cluster_3(structuraldesign_0=data_12, alpha=int_2, maxiterations=int)  # -> structuraldesign_1, formdiagram_1, forcediagram_1

# ----
python_5 = PythonScript(inp_Dta=cluster)  # -> formDiag, str_InpTyp, strCoordsL
# ---------- python_5: Python ----------
from compas_tna.diagrams import FormDiagram
from compas_tna.diagrams import FormDiagram

_inp_Dta = inp_Dta
if _inp_Dta is not None:
    _formDiag = None
    if (_inp_Dta.__class__.__name__ == 'Guid'):
        from compas_rhino.geometry import RhinoMesh
        _formDiag = FormDiagram.from_vertices_and_faces(*(RhinoMesh.from_guid(rgMesh).get_vertices_and_faces()))
        str_InpTyp = 'GUID'
        
    elif (_inp_Dta.__class__.__name__ == 'Mesh'):
        _formDiag = FormDiagram.from_data(_inp_Dta.to_data())
        str_InpTyp = 'cMesh'
        
    elif (_inp_Dta.__class__.__name__ == 'FormDiagram'):
        _formDiag = _inp_Dta
        str_InpTyp = 'cFormDiagram'
        
    formDiag = _formDiag
    
if formDiag is not None:
    coordsL = [formDiag.vertex_coordinates(_vKey) for _vKey in formDiag.vertex.keys()]
    strCoordsL = []
    [strCoordsL.append('{'+str(_coords[0])+','+str(_coords[1])+','+str(_coords[2])+'}') for _coords in coordsL]
# ---------- end python_5 ----------
data_13 = Data(python_5.formDiag)
pt_4 = Point(python_5.strCoordsL)

# ---- group: structDsg
data_14 = Data(cluster_5.structuraldesign_1)

# ----
pt_5 = Point(pt_4)
pt_6 = Point(pt_4)
data_15 = Data(data_10)
data_16 = Data(data_11)

# ---- group: VerticalEquilibrium
cluster_6 = Cluster_4(structuraldesign_0=data_14, maxheight=Slider(6, range=0..10))  # -> structuraldesign_1, formdiagram_1; disabled

# ----
cluster_7 = Cluster_7(data=data_16, pt=pt_6)
cluster_8 = Cluster_7(data=data_15, pt=pt_5)
int_3 = Integer(cluster_8)
int_4 = Integer(cluster_7)
int_5 = Integer(int_3)
data_17 = Data()
python_6 = PythonScript(IL_Anchs=int_5, GhcLoadsL=data_17)  # -> Out, A
data_18 = Data(data_13)
data_19 = Data(data_18)

# ==== cluster AssembleStructuralDesign
formdiagram = ClusterInput()
forcediagram = ClusterInput()
python = PythonScript(formDiag=formdiagram, forceDiag=forcediagram)  # -> structDsg
# ---------- python: Python ----------
#from compas.rpc import Proxy
#reload(compas_ghc.datastructures.StructuralDesign)
import compas_ghc.utilities.InputsOutputsProcessing as _IOP
reload(_IOP)
import compas_ghc.datastructures.StructuralDesign as _SD
reload(_SD)

from compas_ghc.datastructures.StructuralDesign import StructuralDesign as StructDsg


#if form or force diagrams are valid?
_structDsg = StructDsg()

if formDiag is not None:
    _structDsg.SetFormDiagram(formDiag)
    
if forceDiag is not None:
    _structDsg.SetForceDiagram(forceDiag)
    
structDsg = _structDsg
# ---------- end python ----------
structuraldesign = ClusterOutput(python)

# ==== cluster Cluster
structuraldesign_0 = ClusterInput()
createdualdiagram = PythonScript(structDsg_0=structuraldesign_0)  # -> structDsg_1, forceDiag_1
# ---------- createdualdiagram: Python ----------
#from compas_tna.rhino import DiagramHelper
from compas_tna.diagrams import ForceDiagram

if structDsg_0 is not None:
    _structDsg_0    = structDsg_0
    _formDiag       = _structDsg_0.formDiag
    _forceDiag      = ForceDiagram.from_formdiagram(_formDiag)
    _structDsg_0.SetForceDiagram(_forceDiag)

    structDsg_1 = _structDsg_0
    forceDiag_1 = _forceDiag
# ---------- end createdualdiagram ----------
structuraldesign_1 = ClusterOutput(createdualdiagram.structDsg_1)
forcediagram_1 = ClusterOutput(createdualdiagram.forceDiag_1)

# ==== cluster AssembleStructuralDesign_2
formdiagram = ClusterInput()
forcediagram = ClusterInput()
python = PythonScript(formDiag=formdiagram, forceDiag=forcediagram)  # -> structDsg
# ---------- python: Python ----------
#from compas.rpc import Proxy
#reload(compas_ghc.datastructures.StructuralDesign)
from compas_ghc.datastructures.StructuralDesign import StructuralDesign as StructDsg


#if form or force diagrams are valid?
_structDsg = StructDsg()

if formDiag is not None:
    _structDsg.SetFormDiagram(formDiag)
    
if forceDiag is not None:
    _structDsg.SetForceDiagram(forceDiag)
    
structDsg = _structDsg
# ---------- end python ----------
structuraldesign = ClusterOutput(python)

# ==== cluster Cluster_2
structuraldesign_0 = ClusterInput()
createdualdiagram = PythonScript(structDsg_0=structuraldesign_0)  # -> formDiag, forceDiag
# ---------- createdualdiagram: Python ----------
#from compas_tna.rhino import DiagramHelper
from compas_tna.diagrams import ForceDiagram

if structDsg_0 is not None:
    _structDsg_0    = structDsg_0
    
    _formDiag       = _structDsg_0.formDiag
    _forceDiag      = _structDsg_0.forceDiag
    
    
    formDiag        = _formDiag
    forceDiag       = _forceDiag
# ---------- end createdualdiagram ----------
structuraldesign_1 = ClusterOutput(createdualdiagram.formDiag)
forcediagram_1 = ClusterOutput(createdualdiagram.forceDiag)

# ==== cluster Cluster_3
structuraldesign_0 = ClusterInput()
alpha = ClusterInput()  # default: 100
maxiterations = ClusterInput()  # default: 100
data = Data(alpha)
data_2 = Data(maxiterations)
data_3 = Data(structuraldesign_0)
python = PythonScript(structDsg_0=data_3, flt_Alpha=data, int_KMax=data_2)  # -> structDsg_1, formDiag_1, forceDiag_1
# ---------- python: Python ----------
from compas_ghc.utilities.InputsOutputsProcessing import GrasshopperInputsGate
from compas_ghc.utilities.InputsOutputsProcessing import SetDefaultInput as SetDfltInp
from compas_ghc.datastructures.StructuralDesign import StructuralDesign as StructDsg


_structDsg_0=structDsg_0
if GrasshopperInputsGate(_structDsg_0, 'StructuralDesign'):
    
    from compas.rpc import Proxy
    _tna = Proxy('compas_ghc.tna')

    from copy import deepcopy
    from compas_tna.diagrams import FormDiagram
    from compas_tna.diagrams import ForceDiagram
    
    _formDiag_0, _forceDiag_0 = _structDsg_0.OutputDualDiagrams()
    
    _flt_Alpha = SetDfltInp(flt_Alpha, 100)
    _int_KMax = SetDfltInp(int_KMax, 100)

    _formData_0 = deepcopy(_formDiag_0.to_data())
    _forceData_0 = deepcopy(_forceDiag_0.to_data())
    
    try:
        _formData_1, _forceData_1 = _tna.horizontal_nodal_from_data(_formData_0 , _forceData_0, alpha=_flt_Alpha, kmax=_int_KMax)
        try:
            _formDiag_1     = FormDiagram.from_data(_formData_1)
            _forceDiag_1    = ForceDiagram.from_data(_forceData_1)
        
            _structDsg_1    = StructDsg()
            _structDsg_1.SetDualDiagrams(_formDiag_1, _forceDiag_1)
            
            formDiag_1      = _formDiag_1
            forceDiag_1     = _forceDiag_1
            structDsg_1     = _structDsg_1
        except:
            pass
        
    except:
        pass
# ---------- end python ----------
data_4 = Data(python.structDsg_1)
data_5 = Data(python.forceDiag_1)
data_6 = Data(python.formDiag_1)
formdiagram_1 = ClusterOutput(data_6)
structuraldesign_1 = ClusterOutput(data_4)
forcediagram_1 = ClusterOutput(data_5)

# ==== cluster Cluster_4
structuraldesign_0 = ClusterInput()
maxheight = ClusterInput()
maxiterations = ClusterInput()
data = Data(maxiterations)
data_2 = Data(maxheight)
data_3 = Data(structuraldesign_0)
python = PythonScript(structDsg_0=data_3, int_KMax=data, flt_ZMax=data_2)  # -> out, structDsg_1, formDiag_1
# ---------- python: Python ----------
from compas_ghc.utilities.InputsOutputsProcessing import GrasshopperInputsGate
from compas_ghc.utilities.InputsOutputsProcessing import SetDefaultInput as SetDfltInp
from compas_ghc.datastructures.StructuralDesign import StructuralDesign as StructDsg


_structDsg_0=structDsg_0
if GrasshopperInputsGate(_structDsg_0, 'StructuralDesign'):
    
    from compas.rpc import Proxy
    _tna = Proxy('compas_ghc.tna')

    from copy import deepcopy
    from compas_tna.diagrams import FormDiagram
    
    _formDiag_0, _forceDiag_0 = _structDsg_0.OutputDualDiagrams()
    
    _int_KMax = SetDfltInp(int_KMax, 100)
    _flt_ZMax = SetDfltInp(flt_ZMax, 5)

    _formData_0 = deepcopy(_formDiag_0.to_data())

    try:
        
        _formData_1, _scale = _tna.vertical_from_zmax_from_data(_formData_0, zmax = _flt_ZMax, kmax = _int_KMax)
        

        try:
            _formDiag_1     = FormDiagram.from_data(_formData_1)
        
            _structDsg_1    = StructDsg()
            _forceDiag_1    = deepcopy (_forceDiag_0)
            _structDsg_1.SetDualDiagrams(_formDiag_1, _forceDiag_1)
            
            formDiag_1      = _formDiag_1
            structDsg_1     = _structDsg_1
        except:
            pass
        
    except:
        pass
# ---------- end python ----------
data_4 = Data(python.structDsg_1)
data_5 = Data(python.formDiag_1)
formdiagram_1 = ClusterOutput(data_5)
structuraldesign_1 = ClusterOutput(data_4)

# ==== cluster Cluster_5
mesh = ClusterInput()
data = Data(mesh)
python_script = PythonScript(rgMesh=data)  # -> out, cMesh
# ---------- python_script: Python ----------
from compas_ghc.utilities.InputsOutputsProcessing import GrasshopperInputsGate
from compas_ghc.utilities.InputsOutputsProcessing import SetDefaultInput as SetDfltInp
from compas_ghc.datastructures.StructuralDesign import StructuralDesign as StructDsg



_rgMesh = rgMesh
if GrasshopperInputsGate(_rgMesh, 'Guid'):
    from compas_rhino.geometry import RhinoMesh
    from compas.datastructures import Mesh
    _cMesh = Mesh.from_vertices_and_faces(*(RhinoMesh.from_guid(rgMesh).get_vertices_and_faces()))
    cMesh = _cMesh
# ---------- end python_script ----------
data_2 = Data(python_script.cMesh)
diagram = ClusterOutput(data_2)

# ==== cluster Cluster_6
diagram = ClusterInput()
data = Data(diagram)
python = PythonScript(cMesh=data)  # -> out, GUID
# ---------- python: Python ----------
from compas_ghc.utilities.InputsOutputsProcessing import GrasshopperInputsGate
from compas_ghc.utilities.InputsOutputsProcessing import SetDefaultInput as SetDfltInp
#from compas.datastructures import Mesh

_cMesh = cMesh
if GrasshopperInputsGate(_cMesh, 'Mesh'):
    from compas_pattern.cad.rhino.utilities import draw_mesh
    _GUID = draw_mesh(_cMesh, group = False)
    GUID = _GUID
# ---------- end python ----------
data_2 = Data(python.GUID)
mesh = ClusterOutput(data_2)

# ==== cluster Cluster_7
data = ClusterInput()
pt = ClusterInput()

# ---- group: Find indices of points
data_2 = Data(data)
python = PythonScript(infoL_Anchs=data_2)  # -> iL_Anchs, rgPtsL_Anchs; inputs infoL_Anchs: list
# ---------- python: Python ----------
iL_Anchs = []
rgPtsL_Anchs = []
for _info_Anch in infoL_Anchs:
    _typ = str(type(_info_Anch))
    print _typ
    if _typ == "<type 'Point3d'>":
        rgPtsL_Anchs.append(_info_Anch)
        
    elif _typ == "<type 'str'>" or _typ == "<type 'str'>":
        try:
            _i = int(_info_Anch)
            iL_Anchs.append(_info_Anch)
        except:
            pass
# ---------- end python ----------
pt_2 = Point(pt)
int = Integer(python.iL_Anchs)
pt_3 = Point(python.rgPtsL_Anchs)
pt_4 = Point(pt_3)
cp = ClosestPoint(Point=pt_4, Cloud=pt_2)  # -> ClosestPoint, CPIndex, Distance

# ----
trim = TrimTree(Tree=cp.CPIndex, Depth=1)

# ---- group: Find indices of points (continued)
int_2 = Integer(trim)
merge = Merge(Data1=int, Data2=int_2)
cset = CreateSet(List=merge)  # -> Set, Map
int_3 = Integer(cset.Set)

# ----
int_4 = ClusterOutput(int_3)

# ==== cluster CreateLoads
load_vector_s = ClusterInput()
loaded_point_s = ClusterInput()
vec = Vector(load_vector_s)
pt = Point(loaded_point_s)
bool = Boolean()
vec_2 = Vector("0,0,-1")
python = PythonScript(rgPtsL=pt, rgVecsL=vec, rgVec_DfltLd=vec_2, bool_RedistrLds=bool)  # -> out, structLdsL; inputs rgPtsL: list of Point3d, rgVecsL: list of Vector3d, rgVec_DfltLd: Vector3d
# ---------- python: Python ----------
import compas_ghc.datastructures.StructuralDesign as sd
reload(sd)
import compas_ghc.utilities.InputsOutputsProcessing as iop
reload(iop)

#from compas_rhino.geometry import RhinoPoint 

from compas_ghc.utilities.InputsOutputsProcessing import GrasshopperInputsGate
from compas_ghc.utilities.InputsOutputsProcessing import SetDefaultInput as SetDfltInp
from compas_ghc.utilities.InputsOutputsProcessing import MatchListsLengths as MatchLstLgths
from compas_ghc.datastructures.StructuralDesign import StructuralDesign as StructDsg
from compas_ghc.datastructures.StructuralDesign import StructuralLoad as StructLd
#from compas_rhino.geometry import RhinoPoin

#Process inputs and match lists
_rgPtsL = rgPtsL
_rgVecsL = SetDfltInp(rgVecsL, rgVec_DfltLd, bool_LstOtp = True)

_len_Pts = len(_rgPtsL)
_len_Vecs = len(_rgVecsL)
_rgVecsL = MatchLstLgths(_rgPtsL, _rgVecsL)

_zipLdsInfo = zip(_rgPtsL, _rgVecsL)

if _len_Pts > 0: #GrasshopperInputsGate(_rgPtsL, 'Guid'):
    _structLdsL = []
    for __rgPt, __rgVec in _zipLdsInfo:
        
        print (__rgPt, __rgVec)
        __coords    = [__rgPt.X, __rgPt.Y, __rgPt.Z]
        __vec       = [__rgVec.X, __rgVec.Y, __rgVec.Z]
        __structLd  = StructLd(__coords, __vec)
        _structLdsL.append(__structLd)
    structLdsL = _structLdsL
# ---------- end python ----------
data = Data(python.structLdsL)
cghloads = ClusterOutput(data)
