# Grasshopper definition full_mockup3.gh (Grasshopper 0.9.76)
# plug-ins: Python Interpreter, Human, Kangaroo2 Components

rectangle = Rectangle(Plane=PlaneXY(0, 0, 0), XSize="-5 to 5", YSize="-5 to 5", Radius=0)  # -> Rectangle, Length
mesh_uv = MeshSurface(Surface=rectangle.Rectangle, UCount=5, VCount=5, Overhang=True, Equalize=False)
number_slider = Slider(10, range=0..10)  # disabled
mesh = Mesh(mesh_uv)
tstat = TreeStatistics(Tree=mesh)  # -> Paths, Length, Count
# inputs:
# -str type (edge/vertex)
# -str field (eg: q)
# -list of ID
# -list of vals
special_symbols = Panel("""Γ Γ✵

⚓ 
↓↓↓

⓿ ➊

✐ℹⓘ""")
mesh_2 = MeshBrep(Settings={GridMaxCount=0, GridMinCount=16, JaggedSeams=False, MaxEdgeLength=0, MinEdgeLength=0.0001, MinTolerance=0, Refine=True, RefineAngle=0, RelativeTolerance=0.65, SimplePlanes=True, Tolerance=0})
panel = Panel(tstat.Paths)
# Common reloads
# 
# import compas_ghc.datastructures.StructuralDesign as sd
# reload(sd)
# import compas_ghc.utilities.InputsOutputsProcessing as iop
# reload(iop)
# 
# from compas_ghc.fdm import fdm as module_fdm
# reload (module_fdm)
# #_fdm.stop_server()
# #_fdm = Proxy('compas_ghc.fdm.fdm')
# 
# from compas_tna.diagrams import formdiagram
# reload(formdiagram)
nv = NakedVertices(Mesh=mesh)  # -> ClothedIndex, NakedIndex, ClothedPts, NakedPts
random = Random(Range=Domain(0, 1), Number=number_slider, Seed=1)  # disabled
random_2 = Random(Range=Domain(0, 1), Number=number_slider, Seed=0)  # disabled
random_3 = Random(Range=Domain(0, 1), Number=number_slider, Seed=2)  # disabled

# ---- group: Proxy Reset
python = PythonScript()  # -> out, a
# ---------- python: Python ----------
from compas.rpc import Proxy
compas_tna = Proxy('compas_ghc.tna')
compas_tna.stop_server()
compas_tna = Proxy('compas_ghc.tna')
# ---------- end python ----------

# ----
cluster = Cluster_5(mesh=mesh)
mc = MeshCorners(Mesh=mesh, Angle=2.35619449)
demesh = DeconstructMesh(Mesh=mesh)  # -> Vertices, Faces, Colours, Normals
tstat_2 = TreeStatistics(Tree=cluster)  # -> Paths, Length, Count
pt = ConstructPoint(XCoordinate=random_3, YCoordinate=random, ZCoordinate=random_2)  # disabled
python_2 = PythonScript()  # -> out, guid; disabled
# ---------- python_2: Python ----------
from compas_pattern.cad.rhino.utilities import draw_mesh

guid = draw_mesh(quad_mesh_datastructure, group = False)
# ---------- end python_2 ----------
pt_2 = Point(nv.ClothedPts)
pt_3 = Point(mc)
panel_2 = Panel(tstat_2.Paths)
pt_4 = Point(nv.NakedPts)
assemblestructuraldesign = AssembleStructuralDesign_2()  # disabled
specifydesignboundaries = SpecifyDesignBoundaries()  # disabled
createloads = CreateLoads(loaded_point_s=demesh.Vertices)

mesh_3 = Mesh(mesh)  # disabled
demesh_2 = DeconstructMesh(Mesh=mesh_3)  # -> Vertices, Faces, Colours, Normals; disabled
cluster_2 = Cluster_5(mesh=mesh_3)  # disabled
points = PointList(Points=demesh_2.Vertices)  # disabled
cluster_3 = Cluster_6(diagram=cluster_2)  # disabled
mesh_4 = Mesh(cluster_3)  # disabled
demesh_3 = DeconstructMesh(Mesh=mesh_4)  # -> Vertices, Faces, Colours, Normals; disabled
points_2 = PointList(Points=demesh_3.Vertices)  # disabled

data = Data(createloads)

# ---- group: DisassembleStructuralDesign
cluster_4 = Cluster_2()  # -> structuraldesign_1, forcediagram_1; disabled

# ----
cluster_5 = Cluster_10(element_type="e", attribute_name="q", attribute_values="2")
merge = Merge(Data1=cluster_5)
python_3 = PythonScript(x=cluster_5)  # -> out, a; inputs x: list
# ---------- python_3: Python ----------
print (x)
# ---------- end python_3 ----------
specifystructuraldesign = SpecifyStructuralDesign(formdiagram=cluster, anchor_points=simplify(pt_3), loads=data, elements_modifications_instructions=merge)
python_4 = PythonScript()  # -> form, force
# ---------- python_4: Python ----------
from compas_tna.diagrams import FormDiagram
from compas_tna.diagrams import ForceDiagram

_form = FormDiagram.from_json('C:/Users/Kam-Ming Mark Tam/Documents/GitHub/AAG2018/AAG2018/src/day_1/final/aag_02_formdiagram.json')
_force = ForceDiagram.from_json('C:/Users/Kam-Ming Mark Tam/Documents/GitHub/AAG2018/AAG2018/src/day_1/final/aag_03_forcediagram.json')

form = _form
force = _force

_form.set_edges_attribute('fmin', 0.2)
_form.set_edges_attribute('fmax', 5.0)
# ---------- end python_4 ----------
cluster_6 = Cluster_5(mesh=mesh)
python_5 = PythonScript(x=specifystructuraldesign)  # -> out, a
# ---------- python_5: Python ----------
print (x.__class__.__name__)
# ---------- end python_5 ----------
data_2 = Data(python_4.form)
cluster_7 = Cluster_6(diagram=data_2)

# ---- group: Γ
data_3 = Data(specifystructuraldesign)

# ----
crv = Curve(cluster_7)
assemblestructuraldesign_2 = AssembleStructuralDesign(formdiagram=data_3)

# ---- group: Γ
data_4 = Data(data_3)

# ----
cluster_8 = Cluster_6(diagram=specifystructuraldesign)
forcedensitysolver = ForceDensitySolver(structuraldesign_⓿=assemblestructuraldesign_2)  # -> structuraldesign_➊, forcediagram_➊, forces_➊, lengths_➊
mesh_5 = Mesh(cluster_8)
num = Number(Slider(10, range=0..100))
data_5 = Data(data_4)
cluster_9 = Cluster_2()  # -> structuraldesign_1, forcediagram_1
data_6 = Data(cluster_9.structuraldesign_1)
python_6 = PythonScript(cDtaStruct=data_6)  # -> out, vKeysL_Vertices, rgPtsL_Vertices, eKeysL_Edges, rgLnsL_Edges, vKeysL_Anchs, rgPtsL_Anchs, vKeysL_LddVertices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
# ---------- python_6: Python ----------
import compas_ghc.utilities.Convertors as cvt
reload(cvt)

from compas_ghc.utilities.Convertors import DisassembleCompasDataStructures as DiasmCpDtaStruct
from compas_ghc.utilities.Convertors import DrawDisassembledCompasDataStructures as DwDiasmdCpDtaStruct
#from compas_ghc.utilities.InputsOutputsProcessing import GrasshopperInputsGate
#from compas_ghc.utilities.InputsOutputsProcessing import IsCompasDataStructure as IsCpDtaStruct
#from compas_ghc.utilities.InputsOutputsProcessing import SetDefaultInput as SetDfltInp

_cDtaStruct             = cDtaStruct
_dct_DiasmdDta          = DiasmCpDtaStruct(_cDtaStruct , True)

print (_dct_DiasmdDta['faces'].keys())

_vKeysL_Vertices        = _dct_DiasmdDta['vertices']['vKeys'] 
_eKeysL_Edges           = _dct_DiasmdDta['edges']['eKeys'] 
_eKeysL_Edges           = [str(_eKey) for _eKey in _eKeysL_Edges]

_rgPtsL_Vertices, _rgLnsL_Edges = DwDiasmdCpDtaStruct(_dct_DiasmdDta, True)

vKeysL_Vertices         = _vKeysL_Vertices
rgPtsL_Vertices         = _rgPtsL_Vertices

eKeysL_Edges            = _eKeysL_Edges
rgLnsL_Edges            = _rgLnsL_Edges

faceFKeys = _dct_DiasmdDta['faces']['fKeys']
faceVKeys = _dct_DiasmdDta['faces']['vKeys']
import rhinoscriptsyntax as rs


#print (_dct_DiasmdData)
#if IsCpDtaStruct(_cDtaStruct):
#    pass
# ---------- end python_6 ----------
pt_5 = Point(python_6.rgPtsL_Vertices)
demesh_4 = DeconstructMesh(Mesh=mesh_5)  # -> Vertices, Faces, Colours, Normals
tag = TextTag3D(Location=python_6.rgPtsL_Vertices, Text=python_6.vKeysL_Vertices, Size=Slider(0.4, range=0..1), Justification=7)
python_7 = PythonScript(cDtaStruct=data_5)  # -> out, vKeysL_Vertices, rgPtsL_Vertices, eKeysL_Edges, rgLnsL_Edges, vKeysL_Anchs, rgPtsL_Anchs, vKeysL_LddVertices, rgPtsL_LddVertices, rgVecsL_VerticesLds
# ---------- python_7: Python ----------
import compas_ghc.utilities.Convertors as cvt
reload(cvt)

from compas_ghc.utilities.Convertors import DisassembleCompasDataStructures as DiasmCpDtaStruct
from compas_ghc.utilities.Convertors import DrawDisassembledCompasDataStructures as DwDiasmdCpDtaStruct
#from compas_ghc.utilities.InputsOutputsProcessing import GrasshopperInputsGate
#from compas_ghc.utilities.InputsOutputsProcessing import IsCompasDataStructure as IsCpDtaStruct
#from compas_ghc.utilities.InputsOutputsProcessing import SetDefaultInput as SetDfltInp

_cDtaStruct             = cDtaStruct
_dct_DiasmdDta          = DiasmCpDtaStruct(_cDtaStruct)

_vKeysL_Vertices        = _dct_DiasmdDta['vertices']['vKeys'] 
_eKeysL_Edges           = _dct_DiasmdDta['edges']['eKeys'] 
_eKeysL_Edges           = [str(_eKey) for _eKey in _eKeysL_Edges]
_vKeysL_Anchs           = _dct_DiasmdDta['anchors']['vKeys']
_vKeysL_LddVertices     = _dct_DiasmdDta['loads']['vKeys']

_rgPtsL_Vertices, _rgLnsL_Edges, _rgPtsL_Anchs, _rgPtsL_LddVertices, _rgVecsL_VerticesLds = DwDiasmdCpDtaStruct(_dct_DiasmdDta)

vKeysL_Vertices         = _vKeysL_Vertices
rgPtsL_Vertices         = _rgPtsL_Vertices

eKeysL_Edges            = _eKeysL_Edges
rgLnsL_Edges            = _rgLnsL_Edges

vKeysL_Anchs            = _vKeysL_Anchs
rgPtsL_Anchs            = _rgPtsL_Anchs

vKeysL_LddVertices      = _vKeysL_LddVertices
rgPtsL_LddVertices      = _rgPtsL_LddVertices
rgVecsL_VerticesLds     = _rgVecsL_VerticesLds

import rhinoscriptsyntax as rs


#print (_dct_DiasmdData)
#if IsCpDtaStruct(_cDtaStruct):
#    pass
# ---------- end python_7 ----------
cluster_10 = Cluster_6(diagram=forcedensitysolver.forcediagram_➊)
cluster_11 = Cluster_6(diagram=cluster_9.structuraldesign_1)
data_7 = Data(cluster_9.structuraldesign_1)
pt_6 = Point(python_7.rgPtsL_LddVertices)
vec = Vector(python_7.rgVecsL_VerticesLds)
int = Integer(python_7.vKeysL_LddVertices)
txt = Text(python_7.eKeysL_Edges)
crv_2 = Curve(python_7.rgLnsL_Edges)
int_2 = Integer(python_7.vKeysL_Anchs)
pt_7 = Point(python_7.rgPtsL_Anchs)
int_3 = Integer(python_7.vKeysL_Vertices)
pt_8 = Point(python_7.rgPtsL_Vertices)
python_8 = PythonScript(x=data_7)  # -> out, a
# ---------- python_8: Python ----------
x.update_boundaries()
# ---------- end python_8 ----------
data_8 = Data(cluster_9.forcediagram_1)
crv_3 = Curve(crv_2)
python_9 = PythonScript()  # -> out, simplify(a)
# ---------- python_9: Python ----------
a=x
# ---------- end python_9 ----------
python_10 = PythonScript()  # -> out, simplify(a); same code as python_9

pt_9 = Point(pt_8)
pdecon = Deconstruct(Point=pt_9)  # -> XComponent, YComponent, ZComponent
cluster_12 = Cluster_8(num=pdecon.YComponent)
cluster_13 = Cluster_8(num=pdecon.XComponent)
cluster_14 = Cluster_8(num=pdecon.ZComponent)
merge_2 = Merge(Data1=cluster_13, Data2=cluster_12)
sort = SortList(Keys=merge_2)  # -> Keys, ValuesA
item = ListItem(List=sort.Keys, Index=0, Wrap=True)  # -> Item1, Item
num_2 = Number(item.Item)

end = EndPoints(Curve=crv_3)  # -> Start, End
item_2 = ListItem(List=python_9.a, Index=0, Wrap=True)  # -> Item, Item1, Item2
item_3 = ListItem(List=python_10.a, Index=0, Wrap=True)  # -> Item, Item1, Item2
mesh_6 = Mesh(cluster_10)
vec2pt = Vector2Pt(PointA=end.Start, PointB=end.End, Unitize=False)  # -> Vector, Length
pt_10 = ConstructPoint(XCoordinate=item_2.Item, YCoordinate=item_2.Item1, ZCoordinate=item_2.Item2)
pt_11 = ConstructPoint(XCoordinate=item_3.Item, YCoordinate=item_3.Item1, ZCoordinate=item_3.Item2)
pt_12 = Point(flatten(pt_11))
vec_2 = Vector(flatten(pt_10))
demesh_5 = DeconstructMesh(Mesh=mesh_6)  # -> Vertices, Faces, Colours, Normals
vec_3 = Vector(vec2pt.Vector)
Z = UnitZ(Factor=1)
python_11 = PythonScript(cDtaStruct=data_8)  # -> out, vKeysL_Vertices, rgPtsL_Vertices, eKeysL_Edges, rgLnsL_Edges, vKeysL_Anchs, rgPtsL_Anchs, vKeysL_LddVertices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; same code as python_6
number_slider_2 = Slider(0.5, range=0..1)
previewlw = CustomPreviewLineweights(
    Geometry=crv_3,
    Shader={ambient=RGB(0, 0, 0), diffuse=RGB(255, 105, 180), emission=RGB(76, 32, 54), shine=0.5, specular=RGB(255, 255, 255), transparency=0},
    Thickness=Slider(5, range=0..10),
    Absolute=False)
xprod = CrossProduct(VectorA=vec_3, VectorB=Z, Unitize=False)  # -> Vector, Length
curvepoint = PointOnCurve(crv_3, parameter=0.5)

# ---- group: Γ
data_9 = Data(specifystructuraldesign)

# ----
vdis = VectorDisplay(Anchor=pt_12, Vector=vec_2)
int_4 = Integer(Slider(90, range=0..100))
int_5 = Integer(Slider(100, range=0..100))
vec_4 = Vector(xprod.Vector)
points_3 = PointList(Points=demesh_5.Vertices, Size=number_slider_2)
panel_4 = Panel(demesh_5.Vertices)
assemblestructuraldesign_3 = AssembleStructuralDesign(formdiagram=data_9)
python_12 = PythonScript(x=python_11.faceVKeys)  # -> out, simplify(a); same code as python_9
python_13 = PythonScript(x=python_11.faceFKeys)  # -> out, simplify(a); same code as python_9
pl = ConstructPlane(Origin=curvepoint, XAxis=vec_3, YAxis=vec_4)
pt_13 = Point(python_11.rgPtsL_LddVertices)
vec_5 = Vector(python_11.rgVecsL_VerticesLds)
int_6 = Integer(python_11.vKeysL_LddVertices)
int_7 = Integer(python_11.vKeysL_Anchs)
pt_14 = Point(python_11.rgPtsL_Anchs)
int_8 = Integer(python_11.vKeysL_Vertices)
pt_15 = Point(python_11.rgPtsL_Vertices)
points_4 = PointList(Points=pt_12, Size=number_slider_2)
pln = Plane(pl)
crv_4 = Curve(python_11.rgLnsL_Edges)
curvepoint_2 = PointOnCurve(crv_4, parameter=0.5)
txt_2 = Text(python_11.eKeysL_Edges)
panel_5 = Panel(python_13.a)

# ---- group: structDsg
data_10 = Data(assemblestructuraldesign_3)

# ----
C = Curve(crv_3)
vec_6 = Vector(vec_3)
vec_7 = Vector(vec_4)
pln_2 = Plane(pln)
tag_2 = TextTag(Location=curvepoint_2, Text=txt_2)
tag_3 = TextTag3D(Location=pt_15, Text=int_8, Size=Slider(0.5, range=0..1), Justification=7)
panel_6 = Panel(txt_2)

# ---- group: CreateDualDiagram
cluster_15 = Cluster(structuraldesign_0=data_10)  # -> structuraldesign_1, forcediagram_1

# ----
panel_7 = Panel(crv_4)
xprod_2 = CrossProduct(VectorA=vec_6, VectorB=vec_7, Unitize=False)  # -> Vector, Length
boxrec = BoxRectangle(Height=Domain(0, 10))
cluster_16 = Cluster_9(B=pt_7, A=num_2, num=num)
vec_8 = Vector(xprod_2.Vector)

# ---- group: structDsg
data_11 = Data(cluster_15.structuraldesign_1)

# ---- group: HorizontalEquilibrium
cluster_17 = Cluster_3(structuraldesign_0=data_11, alpha=int_4, maxiterations=int_5)  # -> structuraldesign_1, formdiagram_1, forcediagram_1

# ---- group: structDsg
data_12 = Data(cluster_17.structuraldesign_1)

# ---- group: VerticalEquilibrium
cluster_18 = Cluster_4(structuraldesign_0=data_12, maxheight=Slider(6, range=0..10))  # -> structuraldesign_1, formdiagram_1

# ---- group: DisassembleStructuralDesign
cluster_19 = Cluster_2(structuraldesign_0=cluster_18.structuraldesign_1)  # -> structuraldesign_1, forcediagram_1

# ----
cluster_20 = Cluster_6(diagram=cluster_19.forcediagram_1)
cluster_21 = Cluster_6(diagram=cluster_19.structuraldesign_1)
mesh_7 = Mesh(cluster_21)
mesh_8 = Mesh(cluster_20)
box = Box(cluster_16)

# ==== cluster AssembleStructuralDesign
formdiagram = ClusterInput()
forcediagram = ClusterInput()
python = PythonScript(formDiag=formdiagram, forceDiag=forcediagram)  # -> structDsg
# ---------- python: Python ----------
from copy import deepcopy
from compas_ghc.datastructures.StructuralDesign import StructuralDesign as StructDsg

#if form or force diagrams are valid?
_structDsg = StructDsg()

if formDiag is not None:
    _structDsg.SetFormDiagram(deepcopy(formDiag))
    
if forceDiag is not None:
    _structDsg.SetForceDiagram(deepcopy(forceDiag))
    
structDsg = _structDsg
# ---------- end python ----------
structuraldesign = ClusterOutput(python)

# ==== cluster Cluster
structuraldesign_0 = ClusterInput()
createdualdiagram = PythonScript(structDsg_0=structuraldesign_0)  # -> structDsg_1, forceDiag_1
# ---------- createdualdiagram: Python ----------
#from compas_tna.rhino import DiagramHelper
from copy import deepcopy
from compas_tna.diagrams import ForceDiagram

if structDsg_0 is not None:
    _structDsg_0    = deepcopy(structDsg_0)
    _formDiag       = _structDsg_0.formDiag
    _forceDiag      = ForceDiagram.from_formdiagram(_formDiag)
    _structDsg_0.SetForceDiagram(_forceDiag)

    structDsg_1 = _structDsg_0
    forceDiag_1 = _forceDiag
# ---------- end createdualdiagram ----------
structuraldesign_1 = ClusterOutput(createdualdiagram.structDsg_1)
forcediagram_1 = ClusterOutput(createdualdiagram.forceDiag_1)

# ==== cluster AssembleStructuralDesign_2
formdiagram = ClusterInput()
forcediagram = ClusterInput()
python = PythonScript(formDiag=formdiagram, forceDiag=forcediagram)  # -> structDsg
# ---------- python: Python ----------
#from compas.rpc import Proxy
#reload(compas_ghc.datastructures.StructuralDesign)
from compas_ghc.datastructures.StructuralDesign import StructuralDesign as StructDsg


#if form or force diagrams are valid?
_structDsg = StructDsg()

if formDiag is not None:
    _structDsg.SetFormDiagram(formDiag)
    
if forceDiag is not None:
    _structDsg.SetForceDiagram(forceDiag)
    
structDsg = _structDsg
# ---------- end python ----------
structuraldesign = ClusterOutput(python)

# ==== cluster Cluster_2
structuraldesign_0 = ClusterInput()
createdualdiagram = PythonScript(structDsg_0=structuraldesign_0)  # -> formDiag, forceDiag
# ---------- createdualdiagram: Python ----------
#from compas_tna.rhino import DiagramHelper
from compas_tna.diagrams import ForceDiagram

if structDsg_0 is not None:
    _structDsg_0    = structDsg_0
    
    _formDiag       = _structDsg_0.formDiag
    _forceDiag      = _structDsg_0.forceDiag
    
    
    formDiag        = _formDiag
    forceDiag       = _forceDiag
# ---------- end createdualdiagram ----------
structuraldesign_1 = ClusterOutput(createdualdiagram.formDiag)
forcediagram_1 = ClusterOutput(createdualdiagram.forceDiag)

# ==== cluster Cluster_3
structuraldesign_0 = ClusterInput()
alpha = ClusterInput()  # default: 100
maxiterations = ClusterInput()  # default: 100
data = Data(alpha)
data_2 = Data(maxiterations)
data_3 = Data(structuraldesign_0)
python = PythonScript(structDsg_0=data_3, flt_Alpha=data, int_KMax=data_2)  # -> structDsg_1, formDiag_1, forceDiag_1
# ---------- python: Python ----------
from compas_ghc.utilities.InputsOutputsProcessing import GrasshopperInputsGate

_structDsg_0=structDsg_0
if GrasshopperInputsGate(_structDsg_0, 'StructuralDesign'):
    from copy import deepcopy
    
    from compas.rpc import Proxy
    _tna = Proxy('compas_ghc.tna')

    from compas_ghc.utilities.InputsOutputsProcessing import SetDefaultInput as SetDfltInp
    from compas_ghc.datastructures.StructuralDesign import StructuralDesign as StructDsg

    from compas_tna.diagrams import FormDiagram
    from compas_tna.diagrams import ForceDiagram
    
    _formDiag_0, _forceDiag_0 = _structDsg_0.OutputDualDiagrams()
    
    _flt_Alpha = SetDfltInp(flt_Alpha, 100)
    _int_KMax = SetDfltInp(int_KMax, 100)

    _formData_0 = deepcopy(_formDiag_0.to_data())
    _forceData_0 = deepcopy(_forceDiag_0.to_data())
    _formData_1, _forceData_1 = _tna.horizontal_nodal_from_data(_formData_0 , _forceData_0, alpha=_flt_Alpha, kmax=_int_KMax)
    try:
        _formData_1, _forceData_1 = _tna.horizontal_nodal_from_data(_formData_0 , _forceData_0, alpha=_flt_Alpha, kmax=_int_KMax)
        try:
            _formDiag_1     = FormDiagram.from_data(_formData_1)
            _forceDiag_1    = ForceDiagram.from_data(_forceData_1)
        
            _structDsg_1    = StructDsg()
            _structDsg_1.SetDualDiagrams(_formDiag_1, _forceDiag_1)
            
            formDiag_1      = _formDiag_1
            forceDiag_1     = _forceDiag_1
            structDsg_1     = _structDsg_1
        except:
            pass
        
    except:
        pass
# ---------- end python ----------
data_4 = Data(python.structDsg_1)
data_5 = Data(python.forceDiag_1)
data_6 = Data(python.formDiag_1)
formdiagram_1 = ClusterOutput(data_6)
structuraldesign_1 = ClusterOutput(data_4)
forcediagram_1 = ClusterOutput(data_5)

# ==== cluster Cluster_4
structuraldesign_0 = ClusterInput()
maxheight = ClusterInput()
maxiterations = ClusterInput()
data = Data(maxiterations)
data_2 = Data(maxheight)
data_3 = Data(structuraldesign_0)
python = PythonScript(structDsg_0=data_3, int_KMax=data, flt_ZMax=data_2)  # -> out, structDsg_1, formDiag_1
# ---------- python: Python ----------
from compas_ghc.utilities.InputsOutputsProcessing import GrasshopperInputsGate




if GrasshopperInputsGate(structDsg_0, 'StructuralDesign'):
    from compas.rpc import Proxy
    _tna = Proxy('compas_ghc.tna')
    
    from copy import deepcopy
    _structDsg_0 = deepcopy(structDsg_0)
    
    from compas_tna.diagrams import FormDiagram
    
    from compas_ghc.utilities.InputsOutputsProcessing import SetDefaultInput as SetDfltInp
    from compas_ghc.datastructures.StructuralDesign import StructuralDesign as StructDsg
    
    _formDiag_0, _forceDiag_0 = _structDsg_0.OutputDualDiagrams()
    
    _int_KMax = SetDfltInp(int_KMax, 100)
    _flt_ZMax = SetDfltInp(flt_ZMax, 5)

    _formData_0 = deepcopy(_formDiag_0.to_data())

    try:
        
        _formData_1, _scale = _tna.vertical_from_zmax_from_data(_formData_0, zmax = _flt_ZMax, kmax = _int_KMax)
        

        try:
            _formDiag_1     = FormDiagram.from_data(_formData_1)
        
            _structDsg_1    = StructDsg()
            _forceDiag_1    = deepcopy (_forceDiag_0)
            _structDsg_1.SetDualDiagrams(_formDiag_1, _forceDiag_1)
            
            formDiag_1      = _formDiag_1
            structDsg_1     = _structDsg_1
        except:
            pass
        
    except:
        pass
# ---------- end python ----------
data_4 = Data(python.structDsg_1)
data_5 = Data(python.formDiag_1)
formdiagram_1 = ClusterOutput(data_5)
structuraldesign_1 = ClusterOutput(data_4)

# ==== cluster Cluster_5
mesh = ClusterInput()
data = Data(mesh)
python_script = PythonScript(rgMesh=data)  # -> out, cMesh
# ---------- python_script: Python ----------
from compas_ghc.utilities.InputsOutputsProcessing import GrasshopperInputsGate
from compas_ghc.utilities.InputsOutputsProcessing import SetDefaultInput as SetDfltInp
from compas_ghc.datastructures.StructuralDesign import StructuralDesign as StructDsg



_rgMesh = rgMesh
if GrasshopperInputsGate(_rgMesh, 'Guid'):
    from compas_rhino.geometry import RhinoMesh
    from compas.datastructures import Mesh
    _cMesh = Mesh.from_vertices_and_faces(*(RhinoMesh.from_guid(rgMesh).get_vertices_and_faces()))
    cMesh = _cMesh
    
    print cMesh.face.keys()
# ---------- end python_script ----------
data_2 = Data(python_script.cMesh)
diagram = ClusterOutput(data_2)

# ==== cluster Cluster_6
diagram = ClusterInput()
data = Data(diagram)
python = PythonScript(cDtaStruct=data)  # -> out, rgMesh
# ---------- python: Python ----------
import compas_ghc.utilities.InputsOutputsProcessing as iop
reload(iop)
from compas_ghc.utilities import Convertors as _cvt
reload (_cvt)

from compas_ghc.utilities.InputsOutputsProcessing import GrasshopperInputsGate
from compas_ghc.utilities.InputsOutputsProcessing import IsCompasDataStructure as IsCpDtaStruct
from compas_ghc.utilities.InputsOutputsProcessing import SetDefaultInput as SetDfltInp

_cDtaStruct = cDtaStruct

if IsCpDtaStruct(_cDtaStruct):
    from compas_ghc.utilities.Convertors import ConstructRhinocerosMeshFromCompasDataStructure as ConstrRGMeshFrCDtaStruct
    _rgMesh = ConstrRGMeshFrCDtaStruct(_cDtaStruct)
    rgMesh = _rgMesh
# ---------- end python ----------
python_2 = PythonScript(cDtaStruct=data)  # -> out, GUID; disabled
# ---------- python_2: Python ----------
import compas_ghc.utilities.InputsOutputsProcessing as iop
reload(iop)

from compas_ghc.utilities.InputsOutputsProcessing import GrasshopperInputsGate
from compas_ghc.utilities.InputsOutputsProcessing import IsCompasDataStructure as IsCpDtaStruct
from compas_ghc.utilities.InputsOutputsProcessing import SetDefaultInput as SetDfltInp

_cDtaStruct = cDtaStruct

if IsCpDtaStruct(_cDtaStruct):
    from compas_pattern.cad.rhino.utilities import draw_mesh
    _GUID = draw_mesh(_cDtaStruct, group = False)
    GUID = _GUID
# ---------- end python_2 ----------
data_2 = Data(python.rgMesh)
mesh = ClusterOutput(data_2)

# ==== cluster CreateLoads
load_vector_s = ClusterInput()
loaded_point_s = ClusterInput()
vec = Vector(load_vector_s)
pt = Point(loaded_point_s)
bool = Boolean()
vec_2 = Vector("0,0,-1")
python = PythonScript(rgPtsL=pt, rgVecsL=vec, rgVec_DfltLd=vec_2, bool_RedistrLds=bool)  # -> out, structLdsL; inputs rgPtsL: list of Point3d, rgVecsL: list of Vector3d, rgVec_DfltLd: Vector3d
# ---------- python: Python ----------
import compas_ghc.datastructures.StructuralDesign as sd
reload(sd)
import compas_ghc.utilities.InputsOutputsProcessing as iop
reload(iop)

#from compas_rhino.geometry import RhinoPoint 

from compas_ghc.utilities.InputsOutputsProcessing import GrasshopperInputsGate
from compas_ghc.utilities.InputsOutputsProcessing import SetDefaultInput as SetDfltInp
from compas_ghc.utilities.InputsOutputsProcessing import MatchListsLengths as MatchLstLgths
from compas_ghc.datastructures.StructuralDesign import StructuralDesign as StructDsg
from compas_ghc.datastructures.StructuralDesign import StructuralLoad as StructLd
#from compas_rhino.geometry import RhinoPoin

#Process inputs and match lists
_rgPtsL = rgPtsL
_rgVecsL = SetDfltInp(rgVecsL, rgVec_DfltLd, bool_LstOtp = True)

_len_Pts = len(_rgPtsL)
_len_Vecs = len(_rgVecsL)
_rgVecsL = MatchLstLgths(_rgPtsL, _rgVecsL)

_zipLdsInfo = zip(_rgPtsL, _rgVecsL)

if _len_Pts > 0: #GrasshopperInputsGate(_rgPtsL, 'Guid'):
    _structLdsL = []
    for __rgPt, __rgVec in _zipLdsInfo:
        
        print (__rgPt, __rgVec)
        __coords    = [__rgPt.X, __rgPt.Y, __rgPt.Z]
        __vec       = [__rgVec.X, __rgVec.Y, __rgVec.Z]
        __structLd  = StructLd(__coords, __vec)
        _structLdsL.append(__structLd)
    structLdsL = _structLdsL
# ---------- end python ----------
data = Data(python.structLdsL)
cghloads = ClusterOutput(data)

# ==== cluster SpecifyDesignBoundaries
formdiagram = ClusterInput()
anchor_points = ClusterInput()
loads = ClusterInput()
data = Data(formdiagram)
data_2 = Data(anchor_points)
data_3 = Data(loads)
data_4 = Data(data_3)
python = PythonScript(inp_Dta=data)  # -> formDiag, str_InpTyp, strCoordsL
# ---------- python: Python ----------
#from compas_tna.diagrams import formdiagram 
#reload(formdiagram)
from compas_tna.diagrams import FormDiagram

_inp_Dta = inp_Dta
if _inp_Dta is not None:
    _formDiag = None
    if (_inp_Dta.__class__.__name__ == 'Guid'):
        from compas_rhino.geometry import RhinoMesh
        _formDiag = FormDiagram.from_vertices_and_faces(*(RhinoMesh.from_guid(_inp_Dta).get_vertices_and_faces()))
        str_InpTyp = 'GUID'
        
    elif (_inp_Dta.__class__.__name__ == 'Mesh'):
        _formDiag = FormDiagram.from_data(_inp_Dta.to_data())
        str_InpTyp = 'cMesh'
        
    elif (_inp_Dta.__class__.__name__ == 'FormDiagram'):
        _formDiag = _inp_Dta
        str_InpTyp = 'cFormDiagram'
        
    formDiag = _formDiag
    
if formDiag is not None:
    coordsL = [formDiag.vertex_coordinates(_vKey) for _vKey in formDiag.vertex.keys()]
    strCoordsL = []
    [strCoordsL.append('{'+str(_coords[0])+','+str(_coords[1])+','+str(_coords[2])+'}') for _coords in coordsL]
# ---------- end python ----------
python_2 = PythonScript(structLdsL=data_4)  # -> out, strCoordsL_LdsPos, vecsLw_LdsDirMag; inputs structLdsL: list
# ---------- python_2: Python ----------
_structLdsL = structLdsL
_strCoordsL_LdsPos = []
_vecsL = [] 


for _structLd in _structLdsL:
    _coords = _structLd.coords
    _vec    = _structLd.vec
    _strCoordsL_LdsPos.append('{'+str(_coords[0])+','+str(_coords[1])+','+str(_coords[2])+'}')
    _vecsL.append(_vec)

vecsLw_LdsDirMag = [_vecsL] #to address GH's output processing when only one load is supplied
strCoordsL_LdsPos = _strCoordsL_LdsPos
# ---------- end python_2 ----------

# ---- group: !MvToCode
trim = TrimTree(Tree=python.strCoordsL, Depth=1)

# ----
tstat = TreeStatistics(Tree=data_4)  # -> Paths, Length, Count; disabled
panel = Panel(tstat.Paths)  # disabled

data_5 = Data(python.formDiag)
pt = Point(trim)
pt_2 = Point(python_2.strCoordsL_LdsPos)
data_6 = Data(python_2.vecsLw_LdsDirMag)
pt_3 = Point(pt)
pt_4 = Point(pt)
data_7 = Data(data_2)
data_8 = Data(pt_2)
cluster = Cluster_7(data=data_8, pt=pt_4)
cluster_2 = Cluster_7(data=data_7, pt=pt_3)
data_9 = Data(data_5)
int = Integer(cluster_2)
int_2 = Integer(cluster)
data_10 = Data(data_9)
int_3 = Integer(int)
data_11 = Data(data_6)
data_12 = Data(int_2)
python_3 = PythonScript(formDiag_0=data_10, vKeysL_Anchs=int_3, vKeysL_LdsPos=data_12, vecsLw_LdsDirMag=data_11)  # -> out, formDiag_1; inputs vKeysL_Anchs: list of Int32, vKeysL_LdsPos: list of Int32, vecsLw_LdsDirMag: list
# ---------- python_3: Python ----------
from compas_ghc.utilities.InputsOutputsProcessing import GrasshopperInputsGate
from compas_ghc.utilities.InputsOutputsProcessing import SetDefaultInput as SetDfltInp
from compas_ghc.datastructures.StructuralDesign import StructuralDesign as StructDsg


_formDiag_0 =   formDiag_0
_vKeysL_Anchs = vKeysL_Anchs
_vKeysL_LdsPos = vKeysL_LdsPos
_vecsL_LdsDirMag = vecsLw_LdsDirMag[0]

print (_vecsL_LdsDirMag)

if GrasshopperInputsGate(_formDiag_0, 'FormDiagram'):
    if len(_vKeysL_Anchs) > 0:
        _formDiag_0.set_vertices_attribute('is_anchor', True, _vKeysL_Anchs)

    if len(_vKeysL_LdsPos) > 0:
        zipLdsInfo = zip(_vKeysL_LdsPos, _vecsL_LdsDirMag)
        for __vKey_LdPos, __vec_LdDirMag in zipLdsInfo:
            print ('loaded vKey: ', __vKey_LdPos, ' with: ', __vec_LdDirMag)
            _formDiag_0.set_vertex_attributes(__vKey_LdPos, ['px','py','pz'],__vec_LdDirMag)
            
    formDiag_1 = _formDiag_0

#for _vKey, _attr in formDiag_1.vertex.items():
#    print (_vKey, _attr)
# ---------- end python_3 ----------
data_13 = Data(python_3.formDiag_1)
data_14 = Data(data_13)
formdiagram_1 = ClusterOutput(data_14)

# ==== cluster Cluster_8
num = ClusterInput()
num_2 = Number(num)
bnd = Bounds(Numbers=num_2)
dedomain = DeconstructDomain(Domain=bnd)  # -> Start, End
subtraction = Subtraction(A=dedomain.End, B=dedomain.Start)
num_3 = Number(subtraction)
num_4 = ClusterOutput(num_3)

# ==== cluster Cluster_9
A = ClusterInput()
num = ClusterInput()
B = ClusterInput()
A_2 = A(A)
num_2 = Number(num)
num_3 = Number("20")
num_4 = Number("0.1")
B_2 = Base(B)
python = PythonScript(flt_Rng=A_2, flt_DivFac=num_2, flt_DivFac_Dflt=num_3, flt_MinVal=num_4)  # -> out, flt_Val
# ---------- python: Python ----------
if flt_DivFac is None:
    flt_DivFac = flt_DivFac_Dflt
flt_Val=max(flt_MinVal, flt_Rng/flt_DivFac)
# ---------- end python ----------
num_5 = Number(python.flt_Val)
dom = ConstructDomain(DomainStart=expr("-x/2", num_5), DomainEnd=expr("x/2", num_5))
X = X(dom)
box = DomainBox(Base=B_2, X=X, Y=X, Z=X)
box_2 = Box(box)
box_3 = ClusterOutput(box_2)

# ==== cluster ForceDensitySolver
structuraldesign_⓿ = ClusterInput()
data = Data(structuraldesign_⓿)
python = PythonScript(structDsg_0=data)  # -> out, structDsg_1, formDiag_1, fltsL_EdgeForces, fltsL_EdgeLgths, strsL_ErrMsgs
# ---------- python: Python ----------
from compas_ghc.utilities.InputsOutputsProcessing import GrasshopperInputsGate
from compas_ghc.utilities.InputsOutputsProcessing import SetDefaultInput as SetDfltInp
from compas_ghc.datastructures.StructuralDesign import StructuralDesign as StructDsg


_structDsg_0 = structDsg_0
if GrasshopperInputsGate(_structDsg_0, 'StructuralDesign'):
    from compas.rpc import Proxy
    from compas_tna.diagrams import FormDiagram
    from copy import deepcopy
    
    _flt_TtlSWLd = 0 ##CHANGE
    
    _structDsg_0 = deepcopy(structDsg_0)
    _formDiag = structDsg_0.formDiag
    
    _fdm = Proxy('compas_ghc.fdm.fdm')
    
    _formData_0 = structDsg_0.formDiag.to_data()
    _formData_1, _cDctFDSolvRes= _fdm.ForceDensitySolver(_formData_0, _flt_TtlSWLd, bool_LdsRdistrByTrib = False, iMax_LdsRedistr = 5)
    _formDiag_1 = FormDiagram.from_data(_formData_1)
    _structDsg_0.SetFormDiagram(_formDiag_1)
    
    formDiag_1  = _formDiag_1
    structDsg_1 = _structDsg_0
    
    fltsL_EdgeForces    = [_x[0] for _x in _cDctFDSolvRes['f']]
    fltsL_EdgeLgths     = [_x[0] for _x in _cDctFDSolvRes['l']]
# ---------- end python ----------
data_2 = Data(python.structDsg_1)
data_3 = Data(python.fltsL_EdgeForces)
data_4 = Data(python.formDiag_1)
data_5 = Data(python.fltsL_EdgeLgths)
structuraldesign_➊ = ClusterOutput(data_2)
lengths_➊ = ClusterOutput(data_5)
forcediagram_➊ = ClusterOutput(data_4)
forces_➊ = ClusterOutput(data_3)

# ==== cluster SpecifyStructuralDesign
elements_modifications_instructions = ClusterInput()
formdiagram = ClusterInput()
loads = ClusterInput()
anchor_points = ClusterInput()
data = Data(elements_modifications_instructions)
data_2 = Data(formdiagram)
data_3 = Data(loads)
data_4 = Data(anchor_points)
data_5 = Data(data_3)
python = PythonScript(inp_Dta=data_2)  # -> formDiag, str_InpTyp, strCoordsL
# ---------- python: Python ----------
#from compas_tna.diagrams import formdiagram 
#reload(formdiagram)

from compas_tna.diagrams import FormDiagram

_inp_Dta = inp_Dta
if _inp_Dta is not None:
    _formDiag = None
    if (_inp_Dta.__class__.__name__ == 'Guid'):
        from compas_rhino.geometry import RhinoMesh
        _formDiag = FormDiagram.from_vertices_and_faces(*(RhinoMesh.from_guid(_inp_Dta).get_vertices_and_faces()))
        str_InpTyp = 'GUID'
        
    elif (_inp_Dta.__class__.__name__ == 'Mesh'):
        _formDiag = FormDiagram.from_data(_inp_Dta.to_data())
        str_InpTyp = 'cMesh'
        
    elif (_inp_Dta.__class__.__name__ == 'FormDiagram'):
        _formDiag = _inp_Dta
        str_InpTyp = 'cFormDiagram'
        
    formDiag = _formDiag
    
if formDiag is not None:
    coordsL = [formDiag.vertex_coordinates(_vKey) for _vKey in formDiag.vertex.keys()]
    strCoordsL = []
    [strCoordsL.append('{'+str(_coords[0])+','+str(_coords[1])+','+str(_coords[2])+'}') for _coords in coordsL]
# ---------- end python ----------
python_2 = PythonScript(structLdsL=data_5)  # -> out, strCoordsL_LdsPos, vecsLw_LdsDirMag; inputs structLdsL: list; same code as python_2

# ---- group: !MvToCode
trim = TrimTree(Tree=python.strCoordsL, Depth=1)

# ----
data_6 = Data(python.formDiag)
pt = Point(trim)
pt_2 = Point(python_2.strCoordsL_LdsPos)
data_7 = Data(python_2.vecsLw_LdsDirMag)

tstat = TreeStatistics(Tree=data_5)  # -> Paths, Length, Count; disabled
panel = Panel(tstat.Paths)  # disabled

pt_3 = Point(pt)
pt_4 = Point(pt)
data_8 = Data(data_4)
data_9 = Data(pt_2)
cluster = Cluster_7(data=data_9, pt=pt_4)
cluster_2 = Cluster_7(data=data_8, pt=pt_3)
data_10 = Data(data_6)
int = Integer(cluster_2)
int_2 = Integer(cluster)
data_11 = Data(data)
data_12 = Data(data_10)
int_3 = Integer(int)
data_13 = Data(data_7)
data_14 = Data(int_2)
python_3 = PythonScript(formDiag_0=data_12, vKeysL_Anchs=int_3, vKeysL_LdsPos=data_14, vecsLw_LdsDirMag=data_13, instsElemsAttrsModL=data_11)  # -> out, formDiag_1; inputs vKeysL_Anchs: list of Int32, vKeysL_LdsPos: list of Int32, vecsLw_LdsDirMag: list, instsElemsAttrsModL: list
# ---------- python_3: Python ----------
#from compas_ghc.DesignSpecifications import FormDiagramModifications as _FormDiagramModifications
#reload(_FormDiagramModifications)

from compas_ghc.utilities.InputsOutputsProcessing import GrasshopperInputsGate

if GrasshopperInputsGate(formDiag_0, 'FormDiagram'):
    from copy import deepcopy
    _formDiag_0 = deepcopy(formDiag_0)
    
    _vKeysL_Anchs = vKeysL_Anchs
    _vKeysL_LdsPos = vKeysL_LdsPos
    _vecsL_LdsDirMag = vecsLw_LdsDirMag[0]
    _instsElemsAttrsModL = instsElemsAttrsModL
    
    from compas_ghc.utilities.InputsOutputsProcessing import SetDefaultInput as SetDfltInp
    from compas_ghc.datastructures.StructuralDesign import StructuralDesign as StructDsg
    from compas_ghc.DesignSpecifications.FormDiagramModifications import ImplementElementsModifications as ImplElemsMods
    
    if len(_vKeysL_Anchs) > 0:
        _formDiag_0.set_vertices_attribute('is_anchor', True, _vKeysL_Anchs)
        print 
        print
        print _formDiag_0.face.keys()
        _formDiag_0.update_boundaries()
        print _formDiag_0.face.keys()
        print 
        print
        
    if len(_vKeysL_LdsPos) > 0:
        zipLdsInfo = zip(_vKeysL_LdsPos, _vecsL_LdsDirMag)
        for __vKey_LdPos, __vec_LdDirMag in zipLdsInfo:
#            print ('loaded vKey: ', __vKey_LdPos, ' with: ', __vec_LdDirMag)
            _formDiag_0.set_vertex_attributes(__vKey_LdPos, ['px','py','pz'],__vec_LdDirMag)
    
    if len (_instsElemsAttrsModL) > 0 and _instsElemsAttrsModL[0] is not None:
        ImplElemsMods(_formDiag_0, _instsElemsAttrsModL)

    formDiag_1 = _formDiag_0
    
    

#for _vKey, _attr in formDiag_1.vertex.items():
#    print (_vKey, _attr)
# ---------- end python_3 ----------
data_15 = Data(python_3.formDiag_1)
data_16 = Data(data_15)
formdiagram_1 = ClusterOutput(data_16)

# ==== cluster Cluster_10
list_of_elements_keys = ClusterInput()  # If no keys are entered, the attribute value will apply to all elements.
element_type = ClusterInput()  # 'v': vertex, 'e': edge
attribute_name = ClusterInput()  # Input single string/text entry.
attribute_values = ClusterInput()  # Enter one value to be applied to all elements keyed, or enter one value per element keyed.
data = Data(element_type)
data_2 = Data(attribute_name)
data_3 = Data(attribute_values)
data_4 = Data(list_of_elements_keys)
python = PythonScript(char_ElemsTyp=data, str_AttrNm=data_2, keysL_Elems=data_4, dtaL_AttrVals=data_3)  # -> out, instsElemsAttrsMod; inputs keysL_Elems: list, dtaL_AttrVals: list
# ---------- python: Python ----------
from compas_ghc.utilities.InputsOutputsProcessing import GrasshopperInputsGate
from compas_ghc.utilities.InputsOutputsProcessing import SetDefaultInput as SetDfltInp
from compas_ghc.datastructures.StructuralDesign import StructuralDesign as StructDsg

from compas_ghc.datastructures import InstructionsContainer  as _InstructionsContainer 
reload(_InstructionsContainer)

from compas_ghc.datastructures.InstructionsContainer import ElementsAttributesModificationInstructions as ElemsAttrsModInsts

_char_ElemsTyp = char_ElemsTyp
if GrasshopperInputsGate(_char_ElemsTyp, 'str'):
    _instsElemsAttrsMod = ElemsAttrsModInsts(_char_ElemsTyp, str_AttrNm, dtaL_AttrVals, keysL_Elems) 
    
    instsElemsAttrsMod = _instsElemsAttrsMod
# ---------- end python ----------
data_5 = Data(python.instsElemsAttrsMod)
elements_attributes_modification_instruc = ClusterOutput(data_5)

# ==== cluster Cluster_7
data = ClusterInput()
pt = ClusterInput()

# ---- group: Find indices of points
data_2 = Data(data)
python = PythonScript(infoL_Anchs=data_2)  # -> iL_Anchs, rgPtsL_Anchs; inputs infoL_Anchs: list
# ---------- python: Python ----------
iL_Anchs = []
rgPtsL_Anchs = []
for _info_Anch in infoL_Anchs:
    _typ = str(type(_info_Anch))
    print _typ
    if _typ == "<type 'Point3d'>":
        rgPtsL_Anchs.append(_info_Anch)
        
    elif _typ == "<type 'str'>" or _typ == "<type 'str'>":
        try:
            _i = int(_info_Anch)
            iL_Anchs.append(_info_Anch)
        except:
            pass
# ---------- end python ----------
pt_2 = Point(pt)
pt_3 = Point(python.rgPtsL_Anchs)
pt_4 = Point(pt_3)
cp = ClosestPoint(Point=pt_4, Cloud=pt_2)  # -> ClosestPoint, CPIndex, Distance
int = Integer(python.iL_Anchs)
int_2 = Integer(cp.CPIndex)
merge = Merge(Data1=int, Data2=int_2)
cset = CreateSet(List=merge)  # -> Set, Map
int_3 = Integer(cset.Set)

# ----
tstat = TreeStatistics(Tree=pt_2)  # -> Paths, Length, Count; disabled
panel = Panel(tstat.Paths)  # disabled

int_4 = ClusterOutput(int_3)
