# Grasshopper definition DataTreeTrim.gh (Grasshopper 0.9.76)
# plug-ins: Python Interpreter

series = Series(Start=0, Step=1, Count=10)  # -> simplify(graft(Series))
repeat = RepeatData(Data=series, Length=Slider(3, range=0..10))  # -> simplify(graft(Data))
python = PythonScript(GHDtaTr=repeat)  # -> out, a; inputs GHDtaTr: tree
# ---------- python: Python ----------
#for _p in list(x.Paths):
#    print _p.Indices

import Rhino as rc
import Grasshopper as GH
from Grasshopper.Kernel.Data import GH_Path

_dtaTr_Trmd = GH.DataTree[object]()
_GHPaths = _GHDtaTr.Paths
_dtaLL = _GHDtaTr.Branches

for _GHPath, _dtaL in zip (_GHPaths, _dtaLL):
    _intAr_Path     = list(_GHPath.Indices)
    _len_Path       = len(_intAr_Path)
    _len_Path_Trmd  = max(_len_Path - 1, 1)
    _GHPath_Trmd = GH_Path(*_intAr_Path[0:_len_Path_Trmd])
    [_dtaTr_Trmd.Add(_dta, _GHPath_Trmd) for _dta in _dtaL]

a=_dtaTr_Trmd
# ---------- end python ----------
