# Grasshopper definition convert_to_compas_rhino_mesh_and_save.gh (Grasshopper 0.9.80)
# plug-ins: Python Interpreter

number_slider = Slider(20, range=0..100)
rectangle = Rectangle(Plane=PlaneXY(0, 0, 0), XSize="-10 to 10", YSize="-10 to 10", Radius=0)  # -> Rectangle, Length
rectangle_2 = Rectangle(Plane=PlaneXY(0, 0, 0), XSize="-9 to 9", YSize="-9 to 9", Radius=0)  # -> Rectangle, Length
explode = Explode(Curve=rectangle.Rectangle, Recursive=True)  # -> Segments, Vertices
cullpt = CullDuplicates(Points=explode.Vertices, Tolerance=0.1, CullMode=3)  # -> Points, Indices, Valence
pop2d = Populate2D(Region=rectangle_2.Rectangle, Count=number_slider, Seed=1)
del = DelaunayMesh(Points=flatten([pop2d, cullpt.Points]), Plane=PlaneXY(0, 0, 0))
mesh = Mesh(del)
random = Random(Range=" 5 to 20", Number=number_slider, Seed=2)  # -> simplify(Random)
demesh = DeconstructMesh(Mesh=mesh)  # -> Vertices, Faces, Colours, Normals
pdecon = Deconstruct(Point=demesh.Vertices)  # -> XComponent, YComponent, ZComponent
pt = ConstructPoint(XCoordinate=pdecon.XComponent, YCoordinate=pdecon.YComponent, ZCoordinate=random)
conmesh = ConstructMesh(Vertices=pt, Faces=demesh.Faces)
mesh_2 = Mesh(conmesh)
panel = Panel("/Users/tamk/Documents/GitHub/CompasConsolidated/compas_kmmt/data/testing_meshes/random_floating_delaunay.json")
python = PythonScript(rhino_mesh=mesh_2)  # -> out, compas_mesh
# ---------- python: Python ----------
from compas_rhino.geometry import RhinoMesh
from compas.datastructures import Mesh

_crhino_mesh = RhinoMesh(rhino_mesh)

vertices, faces = _crhino_mesh.get_vertices_and_faces()
compas_mesh = Mesh.from_vertices_and_faces(vertices, faces)
# ---------- end python ----------
python_2 = PythonScript(compas_mesh=python.compas_mesh, path=panel)  # -> out, rhino_mesh
# ---------- python_2: Python ----------
import rhinoscriptsyntax as rs
if compas_mesh:
    compas_mesh.to_json(path)
# ---------- end python_2 ----------
