# Grasshopper definition compas_ghc_form-finding_example.gh (Grasshopper 0.9.76)

pt = Point(flatten([Point(9.852083206, 11.61103058, 0), Point(7.347966671, 12.17063808, 0), Point(11.00119972, 13.31096172, 0), Point(5.694787502, 14.33722782, 0), Point(11.89851475, 14.33722782, 0), Point(8.796650887, 10.8088274, 0)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]))
M = Mesh(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)
M_2 = Mesh(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)
pt_2 = Point(flatten([Point(9.852083206, 11.61103058, 0), Point(7.347966671, 12.17063808, 0), Point(11.00119972, 13.31096172, 0), Point(5.694787502, 14.33722782, 0), Point(11.89851475, 14.33722782, 0), Point(8.796650887, 10.8088274, 0)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]))
pt_3 = Point(pt_2)
Z = UnitZ(Factor=1)
pt_4 = Point([Point(12.23845196, 12.78507805, 0), Point(6.316322327, 0.2977048755, 0), Point(7.653113365, 10.06860638, 0), Point(5.813927174, 1.239979386, 0), Point(6.213612556, 5.17833662, 0), Point(12.20464611, 0.4687746465, 0)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])
pt_5 = Point(pt)
Z_2 = UnitZ(Factor=1)
pt_6 = Point([Point(12.23845196, 12.78507805, 0), Point(6.316322327, 0.2977048755, 0), Point(7.653113365, 10.06860638, 0), Point(5.813927174, 1.239979386, 0), Point(6.213612556, 5.17833662, 0), Point(12.20464611, 0.4687746465, 0)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])
neg = Negative(Value=Z)
neg_2 = Negative(Value=Z_2)
vec = LoadVectorS(neg)
vec_2 = LoadVectorS(neg_2)
cluster = Cluster(mesh=M_2)
createloads = CreateLoads(loaded_point_s=pt_4, load_vector_s=vec)
cluster_2 = Cluster(mesh=M)
createloads_2 = CreateLoads(loaded_point_s=pt_6, load_vector_s=vec_2)

# ---- group: Modify Design
cluster_3 = Cluster_8(element_type="e", attribute_name="fmin", attribute_values="0.2")
cluster_4 = Cluster_8(element_type="e", attribute_name="fmax", attribute_values="6")
merge = Merge(Data1=cluster_3, Data2=cluster_4)

# ----
loads = Loads(createloads)
loads_2 = Loads(createloads_2)
neg_3 = Negative(Value=Slider(10, range=0..10))

# ---- group: Modify Design
cluster_5 = Cluster_8(element_type="e", attribute_name="q", attribute_values=neg_3)

# ----
loads_3 = Loads(loads)
data = Data(cluster)
loads_4 = Loads(loads_2)
data_2 = Data(cluster_2)

# ---- group: Initial Design Conditions
cluster_6 = Cluster_3(formdiagram=data, anchor_points=pt_3, loads=loads_3)

cluster_7 = Cluster_3(formdiagram=data_2, anchor_points=pt_5, loads=loads_4)

# ---- group: Modify Design
cluster_8 = Cluster_7(formdiagram=cluster_7, elements_modifications_instructions=cluster_5)

cluster_9 = Cluster_7(formdiagram=cluster_6, elements_modifications_instructions=merge)

# ----
data_3 = Data(cluster_9)
bool = Boolean(Toggle(False))
cluster_10 = Cluster_15(formdiag=data_3, showhidden=bool)  # -> pts, edges_asendpts, edges_aslines, faces_asendpts, faces_aspolylines

data_4 = Data(cluster_8)
cluster_11 = Cluster_4(formdiagram=data_4)
data_5 = Data(cluster_11)

cluster_12 = Cluster_16(formdiag=data_3)  # -> pts, vertexkeys, edgekeys, faceverticeskeys
data_6 = Data(cluster_9)
data_7 = Data(cluster_12.vertexkeys)
data_8 = Data(cluster_12.edgekeys)
crv = Curve(cluster_10.edges_aslines)
pt_7 = Point(cluster_10.edges_asendpts)
cluster_13 = Cluster_4(formdiagram=data_6)
panel = Panel(data_8)
data_9 = Data(cluster_13)

# ---- group: Dual Diagram
cluster_14 = Cluster_6(structuraldesign_⓿=data_9)  # -> structuraldesign_1, forcediagram_1

# ----
data_10 = Data(Slider(2.75, range=0..10))
data_11 = Data(Slider(100, range=0..100))
α = Alpha(Slider(100, range=0..100))
kmax = MaxIterations(Slider(100, range=0..100))
data_12 = Data(cluster_14.structuraldesign_1)

# ---- group: Horizontal Equilibrium
cluster_15 = Cluster_5(structuraldesign_⓿=data_12, alpha=α, maxiterations=kmax)  # -> structuraldesign_➊, formdiagram_➊, forcediagram_➊, log

# ----
structdsg_⓿ = StructuralDesign⓿(cluster_15.structuraldesign_➊)

# ---- group: Vertical Equilibrium
cluster_16 = Cluster_10(structuraldesign_⓿=structdsg_⓿, maxiterations=data_11, maxheight=data_10)  # -> structuraldesign_➊, formdiagram_➊

# ----
data_13 = Data(cluster_15.formdiagram_➊)
data_14 = Data(cluster_15.forcediagram_➊)
data_15 = Data(cluster_16.formdiagram_➊)
data_16 = Data(cluster_16.structuraldesign_➊)
cluster_17 = Cluster_9(diagram=data_14)
cluster_18 = Cluster_9(diagram=data_13)
cluster_19 = Cluster_9(diagram=data_15)
data_17 = Data(data_5)
mesh = Mesh(cluster_18)
mesh_2 = Mesh(cluster_17)

# ---- group: Form Density Method
forcedensitysolver = ForceDensitySolver(structuraldesign_⓿=data_17)  # -> structuraldesign_➊, forcediagram_➊, forces_➊, lengths_➊, forcedensities_➊, loads_➊, residual_forces_➊

# ----
mesh_3 = Mesh(cluster_19)
cluster_20 = Cluster_9(diagram=forcedensitysolver.forcediagram_➊)
mesh_4 = Mesh(cluster_20)

# ---- group: Visualiser
cluster_21 = Cluster_14(structdsg=forcedensitysolver.structuraldesign_➊, e_id=Slider(15, range=0..100))

cluster_22 = Cluster_14(structdsg=data_16, e_id=Slider(44, range=0..100))

# ==== cluster Cluster
mesh = ClusterInput()
data = Data(mesh)
python_script = PythonScript(RGMesh=data)  # -> out, CGHDiag; inputs RGMesh: Mesh
# ---------- python_script: Python ----------
from compas_ghc.DataStructures.CommonMethods import ElementsMappings
from compas_ghc.DataStructures.CommonMethods import ElementsIdentifiers
from compas_ghc.DataStructures.CommonMethods import ElementsRetrival
from compas_ghc.DataStructures.CommonMethods import RGMeshConversion 
from compas_ghc.Utilities import RCGeometriesDrawers
reload(RGMeshConversion )
reload(ElementsMappings)
reload(ElementsIdentifiers)
reload(ElementsRetrival)
reload(RCGeometriesDrawers)

from compas_ghc.DataStructures import CGHDataTypesBase
reload(CGHDataTypesBase)              
from compas_ghc.DataStructures import CGHDiagrams    
reload(CGHDiagrams)              

from compas_ghc.Utilities.InputsOutputsProcessing           import GrasshopperInputsGate
if GrasshopperInputsGate(RGMesh, 'Mesh'):
    from compas_ghc.DataStructures.CGHDiagrams                  import CGHFormDiagram
    _RGMesh         = RGMesh
    _CGHDiag        = CGHFormDiagram.FromRGMesh(_RGMesh)
    CGHDiag = _CGHDiag
# ---------- end python_script ----------
data_2 = Data(python_script.CGHDiag)
panel = Panel(data_2)
diagram = ClusterOutput(data_2)

# ==== cluster Cluster_3
formdiagram = ClusterInput()
loads = ClusterInput()
elements_modifications_instructions = ClusterInput()
anchor_points = ClusterInput()
data = Data(elements_modifications_instructions)
data_2 = Data(loads)
data_3 = Data(formdiagram)
data_4 = Data(anchor_points)
data_5 = Data(data_2)
python = PythonScript(inp_Dta=data_3)  # -> formDiag, str_InpTyp, strCoordsL
# ---------- python: Python ----------
from compas_ghc.DataStructures.CGHDiagrams import CGHFormDiagram
if inp_Dta is not None:
    from copy import deepcopy
    _inp_Dta = deepcopy(inp_Dta)
    
    _formDiag = None
    _str_ClsNm = _inp_Dta.__class__.__name__
    
    if (_str_ClsNm == 'Guid'):
        from compas_rhino.geometry import RhinoMesh
        _formDiag = CGHFormDiagram.from_vertices_and_faces(*(RhinoMesh.from_guid(_inp_Dta).get_vertices_and_faces()))
        str_InpTyp = 'GUID'
    elif (_str_ClsNm == 'Mesh' or _str_ClsNm == 'CGHDiagram'):
        _formDiag = CGHFormDiagram.from_data(_inp_Dta.to_data())
        str_InpTyp = 'cDtaStruct'
    elif (_str_ClsNm == 'CGHFormDiagram'):
        _formDiag = _inp_Dta
        str_InpTyp = 'CGHFormDiagram'
        
    formDiag = _formDiag
    
if formDiag is not None:
    coordsL = [formDiag.vertex_coordinates(_vKey) for _vKey in formDiag.vertex.keys()]
    strCoordsL = []
    [strCoordsL.append('{'+str(_coords[0])+','+str(_coords[1])+','+str(_coords[2])+'}') for _coords in coordsL]
# ---------- end python ----------
python_2 = PythonScript(structLdsL=data_5)  # -> out, strCoordsL_LdsPos, vecsLw_ApldLdsDirMag, vecsLw_GblLdsDirMag; inputs structLdsL: list
# ---------- python_2: Python ----------
from copy import deepcopy
_structLdsL = deepcopy(structLdsL)
_strCoordsL_LdsPos = []
_vecsL_ApldLdsDirMag = [] 
_vecsL_GblLdsDirMag = []

for _structLd in _structLdsL:
    if not _structLd.IsGlobalLoad():
        _coords = _structLd.coords
        _vec    = _structLd.vec
        _strCoordsL_LdsPos.append('{'+str(_coords[0])+','+str(_coords[1])+','+str(_coords[2])+'}')
        _vecsL_ApldLdsDirMag.append(_vec)
    else:
        _vecsL_GblLdsDirMag.append(_structLd.vec)

vecsLw_ApldLdsDirMag = [_vecsL_ApldLdsDirMag] #to address GH's output processing when only one load is supplied
vecsLw_GblLdsDirMag = [_vecsL_GblLdsDirMag]
strCoordsL_LdsPos = _strCoordsL_LdsPos
# ---------- end python_2 ----------

# ---- group: !MvToCode
trim = TrimTree(Tree=python.strCoordsL, Depth=1)

# ----
data_6 = Data(python.formDiag)
pt = Point(trim)
pt_2 = Point(python_2.strCoordsL_LdsPos)
data_7 = Data(python_2.vecsLw_GblLdsDirMag)
data_8 = Data(python_2.vecsLw_ApldLdsDirMag)
pt_3 = Point(pt)
pt_4 = Point(pt)
data_9 = Data(data_4)
data_10 = Data(pt_2)
cluster = Cluster_2(data=data_10, pt=pt_4)
cluster_2 = Cluster_2(data=data_9, pt=pt_3)
data_11 = Data(data_6)
int = Integer(cluster_2)
int_2 = Integer(cluster)
data_12 = Data(data_11)
int_3 = Integer(int)
data_13 = Data(data_7)
data_14 = Data(data_8)
data_15 = Data(data)
data_16 = Data(int_2)
python_3 = PythonScript(
    formDiag_0=data_12,
    vKeysL_Anchs=int_3,
    vKeysL_LdsPos=data_16,
    vecsLw_LdsDirMag=data_14,
    vecsLw_GblLdsDirMag=data_13,
    instsElemsAttrsModL=data_15)  # -> out, formDiag_1; inputs vKeysL_Anchs: list, vKeysL_LdsPos: list, vecsLw_LdsDirMag: list, vecsLw_GblLdsDirMag: list, instsElemsAttrsModL: list
# ---------- python_3: Python ----------
from compas_ghc.Utilities.InputsOutputsProcessing import GrasshopperInputsGate
from compas_ghc.DesignSpecification import FormDiagramModifications 
reload(FormDiagramModifications)

if GrasshopperInputsGate(formDiag_0, 'CGHFormDiagram'):
    from copy import deepcopy
    _formDiag_1 = formDiag_0.CreateDuplicate()
    
    _vKeysL_Anchs = deepcopy(vKeysL_Anchs)
    _vKeysL_LdsPos = deepcopy(vKeysL_LdsPos)
    _vecsL_LdsDirMag = deepcopy(vecsLw_LdsDirMag[0])
    _vecsL_GblLdsDirMag = deepcopy(vecsLw_GblLdsDirMag[0])
    _instsElemsAttrsModL = deepcopy(instsElemsAttrsModL)
    
    from compas_ghc.Utilities.InputsOutputsProcessing import SetDefaultInput as SetDfltInp
    from compas_ghc.DataStructures.CGHStructuralDesign import CGHStructuralDesign as StructDsg
    from compas_ghc.DesignSpecification.FormDiagramModifications import ImplementElementsModifications as ImplElemsMods
    
    if len(_vKeysL_Anchs) > 0:
        _formDiag_1.set_vertices_attribute('is_anchor', True, _vKeysL_Anchs)
        _formDiag_1.update_boundaries()
        
    if len(_vKeysL_LdsPos) > 0:
        zipLdsInfo = zip(_vKeysL_LdsPos, _vecsL_LdsDirMag)
        for __vKey_LdPos, __vec_LdDirMag in zipLdsInfo:
            _formDiag_1.set_vertex_attributes(__vKey_LdPos, ['px','py','pz'],__vec_LdDirMag)
            
    if len(_vecsL_GblLdsDirMag) > 0:
        if not hasattr(_formDiag_1,'vec_GblArLd'):
            setattr(_formDiag_1,'vec_GblArLd',[0,0,0])
        for __vec in _vecsL_GblLdsDirMag:
            _formDiag_1.vec_GblArLd = [_cnpt_DiagCurr + _cnpt_Imp for _cnpt_DiagCurr, _cnpt_Imp in zip(_formDiag_1.vec_GblArLd, __vec)]
        

    if len (_instsElemsAttrsModL) > 0 and _instsElemsAttrsModL[0] is not None:
        ImplElemsMods(_formDiag_1, _instsElemsAttrsModL)

    formDiag_1 = _formDiag_1
    
    

#for _vKey, _attr in formDiag_1.vertex.items():
#    print (_vKey, _attr)
# ---------- end python_3 ----------
data_17 = Data(python_3.formDiag_1)
formdiagram_1 = ClusterOutput(data_17)

# ==== cluster CreateLoads
load_vector_s = ClusterInput()
loaded_point_s = ClusterInput()
vec = Vector(load_vector_s)
pt = Point(loaded_point_s)
vec_2 = Vector("0,0,-1")
python = PythonScript(rgPtsL=pt, rgVecsL=vec, rgVec_DfltLd=vec_2)  # -> out, structLdsL; inputs rgPtsL: list of Point3d, rgVecsL: list of Vector3d, rgVec_DfltLd: Vector3d
# ---------- python: Python ----------
from compas_ghc.Utilities.InputsOutputsProcessing import GrasshopperInputsGate
from compas_ghc.Utilities.InputsOutputsProcessing import SetDefaultInput as SetDfltInp
from compas_ghc.Utilities.InputsOutputsProcessing import MatchListsLengths as MatchLstLgths
from compas_ghc.DataStructures.CGHStructuralLoad  import CGHStructuralLoad as CGHStructLd

#Process inputs and match lists
_rgPtsL = rgPtsL
_rgVecsL = SetDfltInp(rgVecsL, rgVec_DfltLd, bool_LstOtp = True)

_len_Pts = len(_rgPtsL)
_len_Vecs = len(_rgVecsL)
_structLdsL = []

if _len_Pts == 0 and _len_Vecs>0:
    for __vec in _rgVecsL:
        __structLd  = CGHStructLd(vec_LdDirMag=__vec) #Total gravity
        _structLdsL.append(__structLd)

elif _len_Pts > 0:
    _rgVecsL = MatchLstLgths(_rgPtsL, _rgVecsL)
    _zipLdsInfo = zip(_rgPtsL, _rgVecsL)
    if _len_Pts > 0 or _len_Vecs > 0: 
        
        for __rgPt, __rgVec in _zipLdsInfo:
            print (__rgPt, __rgVec)
            __coords    = [__rgPt.X, __rgPt.Y, __rgPt.Z]
            __vec       = [__rgVec.X, __rgVec.Y, __rgVec.Z]
            __structLd  = CGHStructLd(__coords, __vec)
            _structLdsL.append(__structLd)

structLdsL = _structLdsL
# ---------- end python ----------
data = Data(python.structLdsL)
cghloads = ClusterOutput(data)

# ==== cluster Cluster_4
formdiagram = ClusterInput()
forcediagram = ClusterInput()
data = Data(formdiagram)
data_2 = Data(forcediagram)
python = PythonScript(formDiag=data, forceDiag=data_2)  # -> structDsg
# ---------- python: Python ----------
from compas_ghc.DataStructures import CGHDiagrams
reload(CGHDiagrams)
from compas_ghc.DataStructures import CGHStructuralDesign as _CGHStructDsg
reload(_CGHStructDsg)

from compas_ghc.DataStructures.CGHStructuralDesign import CGHStructuralDesign as StructDsg

#if form or force diagrams are valid?
_structDsg = StructDsg()

if formDiag is not None:
    _structDsg.SetFormDiagram(formDiag.CreateDuplicate())

if forceDiag is not None:
    _structDsg.SetForceDiagram(forceDiag.CreateDuplicate())
    
structDsg = _structDsg
# ---------- end python ----------
data_3 = Data(python)
structuraldesign = ClusterOutput(data_3)

# ==== cluster Cluster_5
structuraldesign_⓿ = ClusterInput()
alpha = ClusterInput()  # default: 100
maxiterations = ClusterInput()  # default: 100
data = Data(alpha)
data_2 = Data(maxiterations)
data_3 = Data(structuraldesign_⓿)
python = PythonScript(structDsg_0=data_3, flt_Alpha=data, int_KMax=data_2)  # -> out, structDsg_1, formDiag_1, forceDiag_1; inputs int_KMax: Int32
# ---------- python: Python ----------
from compas_ghc.Utilities.InputsOutputsProcessing import GrasshopperInputsGate

if GrasshopperInputsGate(structDsg_0, 'CGHStructuralDesign'):
    _structDsg_0 = structDsg_0.CreateDuplicate()
    
    from compas.rpc import Proxy
    _TNA = Proxy('compas_ghc.StructuralSolvers.TNA.Equilibrium')
#    _TNA.stop_server()
#    _TNA = Proxy('compas_ghc.StructuralSolvers.TNA.Equilibrium')

    from compas_ghc.Utilities.InputsOutputsProcessing import SetDefaultInput as SetDfltInp
    from compas_ghc.DataStructures.CGHStructuralDesign import CGHStructuralDesign as StructDsg

    from compas_ghc.DataStructures.CGHDiagrams import CGHFormDiagram as FormDiagram
    from compas_ghc.DataStructures.CGHDiagrams import CGHForceDiagram as ForceDiagram
    
    _formDiag_0, _forceDiag_0 = _structDsg_0.OutputDualDiagrams()
    
    _flt_Alpha = SetDfltInp(flt_Alpha, 100)
    _int_KMax = SetDfltInp(int_KMax, 100)

    _formData_0 = _formDiag_0.to_data()
    _forceData_0 = _forceDiag_0.to_data()
    
    try:
        _formData_1, _forceData_1 = _TNA.HorizontalEquilibrium_fromData(_formData_0 , _forceData_0, alpha=_flt_Alpha, kmax=_int_KMax)
        try:
            _formDiag_1     = FormDiagram.from_data(_formData_1)
            _forceDiag_1    = ForceDiagram.from_data(_forceData_1)
        
            _structDsg_1    = StructDsg()
            _structDsg_1.SetDualDiagrams(_formDiag_1, _forceDiag_1)
            
            formDiag_1      = _formDiag_1
            forceDiag_1     = _forceDiag_1
            structDsg_1     = _structDsg_1
        except:
            pass
    except:
        pass
# ---------- end python ----------
data_4 = Data(python.structDsg_1)
data_5 = Data(python.forceDiag_1)
data_6 = Data(python.formDiag_1)
data_7 = Data()
formdiagram_➊ = ClusterOutput(data_6)
log = ClusterOutput(data_7)
structuraldesign_➊ = ClusterOutput(data_4)
forcediagram_➊ = ClusterOutput(data_5)

# ==== cluster Cluster_6
structuraldesign_⓿ = ClusterInput()
data = Data(structuraldesign_⓿)
createdualdiagram = PythonScript(structDsg_0=data)  # -> structDsg_1, forceDiag_1
# ---------- createdualdiagram: Python ----------
from compas_ghc.DataStructures import CGHStructuralDesign as _CGHStructDsg
reload(_CGHStructDsg)
from compas_ghc.DataStructures.CommonMethods import ElementsMappings
from compas_ghc.DataStructures.CommonMethods import ElementsIdentifiers
from compas_ghc.DataStructures.CommonMethods import ElementsRetrival
from compas_ghc.DataStructures.CommonMethods import RGMeshConversion 
from compas_ghc.Utilities import RCGeometriesDrawers
reload(RGMeshConversion )
reload(ElementsMappings)
reload(ElementsIdentifiers)
reload(ElementsRetrival)
reload(RCGeometriesDrawers)
from compas_ghc.DataStructures import CGHDataTypesBase
reload(CGHDataTypesBase)              
from compas_ghc.DataStructures import CGHDiagrams    
reload(CGHDiagrams)              

from compas_ghc.DataStructures.CGHDiagrams import CGHForceDiagram 
from compas_ghc.DataStructures.CGHStructuralDesign import CGHStructuralDesign as CGHStructDsg
if structDsg_0 is not None:
    _structDsg_1        = structDsg_0.CreateDuplicate()
    _formDiag_1         = _structDsg_1.formDiag
    _forceDiag_1        = CGHForceDiagram.from_formdiagram(_formDiag_1)
    _structDsg_1.SetForceDiagram(_forceDiag_1)
    
    _degMax, _vKey = _forceDiag_1.VertexWithMaxDegree()
    _forceDiag_1.set_vertex_attribute(name='is_fixed', value=True, key=_vKey)
    
    structDsg_1 = _structDsg_1
    forceDiag_1 = _forceDiag_1
# ---------- end createdualdiagram ----------
data_2 = Data(createdualdiagram.forceDiag_1)
data_3 = Data(createdualdiagram.structDsg_1)
structuraldesign_1 = ClusterOutput(data_3)
forcediagram_1 = ClusterOutput(data_2)

# ==== cluster Cluster_7
elements_modifications_instructions = ClusterInput()
formdiagram = ClusterInput()
data = Data(elements_modifications_instructions)
data_2 = Data(formdiagram)
python = PythonScript(inp_Dta=data_2)  # -> formDiag, str_InpTyp, strCoordsL; same code as python
data_3 = Data(python.formDiag)
data_4 = Data(data_3)
data_5 = Data(data)
data_6 = Data(data_4)
python_2 = PythonScript(formDiag_0=data_6, instsElemsAttrsModL=data_5)  # -> out, formDiag_1; inputs instsElemsAttrsModL: list
# ---------- python_2: Python ----------
from compas_ghc.Utilities.InputsOutputsProcessing import GrasshopperInputsGate
from compas_ghc.DesignSpecification import FormDiagramModifications 
from copy import deepcopy

reload(FormDiagramModifications)

if GrasshopperInputsGate(formDiag_0, 'CGHFormDiagram'):
    _formDiag_1 = formDiag_0.CreateDuplicate()
    
    _instsElemsAttrsModL = deepcopy(instsElemsAttrsModL)
    
    from compas_ghc.DesignSpecification.FormDiagramModifications import ImplementElementsModifications as ImplElemsMods
    
    if len (_instsElemsAttrsModL) > 0 and _instsElemsAttrsModL[0] is not None:
        ImplElemsMods(_formDiag_1, _instsElemsAttrsModL)

    formDiag_1 = _formDiag_1
    print list(formDiag_1.edges())
    

#for _vKey, _attr in formDiag_1.vertex.items():
#    print (_vKey, _attr)
# ---------- end python_2 ----------
data_7 = Data(python_2.formDiag_1)
formdiagram_1 = ClusterOutput(data_7)

# ==== cluster Cluster_8
list_of_elements_keys = ClusterInput()  # If no keys are entered, the attribute value will apply to all elements.
attribute_values = ClusterInput()  # Enter one value to be applied to all elements keyed, or enter one value per element keyed.
element_type = ClusterInput()  # 'v': vertex, 'e': edge
attribute_name = ClusterInput()  # Input single string/text entry.
data = Data(attribute_values)
data_2 = Data(list_of_elements_keys)
data_3 = Data(element_type)
data_4 = Data(attribute_name)
python = PythonScript(char_ElemsTyp=data_3, strsL_AttrNm=data_4, keysL_Elems=data_2, dtaL_AttrVals=data)  # -> out, instsElemsAttrsModL; inputs strsL_AttrNm: list, keysL_Elems: list, dtaL_AttrVals: list
# ---------- python: Python ----------
from compas_ghc.DesignSpecification import InstructionsContainer  as _InstructionsContainer 
reload(_InstructionsContainer)
from compas_ghc.Utilities.InputsOutputsProcessing import MatchListsLengths as MatchLstLgths
from compas_ghc.Utilities.InputsOutputsProcessing import GrasshopperInputsGate
from compas_ghc.Utilities.InputsOutputsProcessing import SetDefaultInput as SetDfltInp

from compas_ghc.DesignSpecification.InstructionsContainer import ElementsAttributesModificationInstructions as ElemsAttrsModInsts

_char_ElemsTyp = char_ElemsTyp
if GrasshopperInputsGate(_char_ElemsTyp, 'str'):
    _strsL_AttrNm       = list(strsL_AttrNm)
    _keysL_Elems        = list(keysL_Elems)
    _dtaL_AttrVals      = list(dtaL_AttrVals)
    
    _len_AttrNms        = len(_strsL_AttrNm)
    _len_Elems          = len(_keysL_Elems)
    _len_AttrVals       = len(dtaL_AttrVals)
    
    _bool_NmValMtch     = _len_AttrNms == _len_AttrVals
    _bool_AllLgthsMtch  = _len_Elems == _len_AttrNms and _bool_NmValMtch
    
    _instsElemsAttrsModL = []
    if _bool_AllLgthsMtch and _len_Elems >= 1:
        _constrMtd = 0
    elif _len_Elems > 1 and _bool_NmValMtch and _len_AttrNms == 1:
        _constrMtd = 1
    elif _len_Elems == 1 and _bool_NmValMtch and _len_AttrNms > 1:
        MatchLstLgths(_strsL_AttrNms, _keysL_Elems)
        _constrMtd = 0
    elif _len_Elems == 0 and _bool_NmValMtch and _len_AttrNms == 1:
        _constrMtd = 2

    if _constrMtd == 0:
       for __key_Elem, __str_AttrNm, __dtaVal in zip(_keysL_Elems, _strsL_AttrNm, dtaL_AttrVals):
            _instsElemsAttrsModL.append(ElemsAttrsModInsts(_char_ElemsTyp, __str_AttrNm, __dtaVal, __key_Elem))
    elif _constrMtd == 1:
       _instsElemsAttrsModL.append(ElemsAttrsModInsts(_char_ElemsTyp, _strsL_AttrNm[0], _dtaL_AttrVals[0], _keysL_Elems))
    elif _constrMtd == 2:
       _instsElemsAttrsModL.append(ElemsAttrsModInsts(_char_ElemsTyp, _strsL_AttrNm[0], _dtaL_AttrVals[0], _keysL_Elems)) 
       
    instsElemsAttrsModL = _instsElemsAttrsModL
# ---------- end python ----------
data_5 = Data(python.instsElemsAttrsModL)
elements_attributes_modification_instruc = ClusterOutput(data_5)

# ==== cluster Cluster_9
diagram = ClusterInput()
data = Data(diagram)
python = PythonScript(cDtaStruct=data)  # -> out, rgMesh
# ---------- python: Python ----------
from compas_ghc.Utilities.InputsOutputsProcessing import GrasshopperInputsGate
from compas_ghc.Utilities.InputsOutputsProcessing import IsCompasDataStructure as IsCpDtaStruct
from compas_ghc.Utilities.InputsOutputsProcessing import SetDefaultInput as SetDfltInp


if IsCpDtaStruct(cDtaStruct):
    _str_ClsNm = cDtaStruct.__class__.__name__
    bool_ExclExt = False if _str_ClsNm != 'CGHFormDiagram' else True
    _cDtaStruct = cDtaStruct.CreateDuplicate()
    _rgMesh = _cDtaStruct.ToRGMesh(bool_ExclExt)
    rgMesh = _rgMesh
# ---------- end python ----------
data_2 = Data(python.rgMesh)
mesh = ClusterOutput(data_2)

# ==== cluster Cluster_10
structuraldesign_⓿ = ClusterInput()
maxheight = ClusterInput()
maxiterations = ClusterInput()
data = Data(maxiterations)
data_2 = Data(maxheight)
data_3 = Data(structuraldesign_⓿)
python = PythonScript(structDsg_0=data_3, int_KMax=data, flt_ZMax=data_2)  # -> out, structDsg_1, formDiag_1; inputs int_KMax: Int32
# ---------- python: Python ----------
from compas_ghc.Utilities.InputsOutputsProcessing import GrasshopperInputsGate

if GrasshopperInputsGate(structDsg_0, 'CGHStructuralDesign'):
    from compas.rpc import Proxy
    _TNA = Proxy('compas_ghc.StructuralSolvers.TNA.Equilibrium')
#    _TNA.stop_server()
    
    _structDsg_0 = structDsg_0.CreateDuplicate()
    
    from compas_ghc.DataStructures.CGHDiagrams import CGHFormDiagram
    from compas_ghc.DataStructures.CGHStructuralDesign import CGHStructuralDesign as CGHStructDsg
    from compas_ghc.Utilities.InputsOutputsProcessing import SetDefaultInput as SetDfltInp
    
    _formDiag_0, _forceDiag_0 = _structDsg_0.OutputDualDiagrams()
    
    
    _int_KMax       = SetDfltInp(int_KMax, 100)
    _flt_ZMax       = SetDfltInp(flt_ZMax, 5)
    _flt_GblArLd    = _structDsg_0.vec_GblArLd[2]

    _formData_0 = _formDiag_0.to_data()
    
    _formData_1, _scale = _TNA.VerticalEquilibrium_fromZMax_fromData(_formData_0, zmax = _flt_ZMax, kmax = _int_KMax, density = _flt_GblArLd)           
    _formDiag_1     = CGHFormDiagram.from_data(_formData_1)
    _forceDiag_1    = _forceDiag_0.CreateDuplicate()
    _structDsg_1    = CGHStructDsg()
    _structDsg_1.SetDualDiagrams(_formDiag_1, _forceDiag_1)
    
    formDiag_1      = _formDiag_1
    structDsg_1     = _structDsg_1
# ---------- end python ----------
data_4 = Data(python.structDsg_1)
data_5 = Data(python.formDiag_1)
formdiagram_➊ = ClusterOutput(data_5)
structuraldesign_➊ = ClusterOutput(data_4)

# ==== cluster Cluster_14
show_hide = ClusterInput()
structdsg = ClusterInput()
v_id = ClusterInput()
e_id = ClusterInput()
f_id = ClusterInput()
txt = Text(v_id)
txt_2 = Text(e_id)
txt_3 = Text(f_id)
bool = Boolean(show_hide)
cluster = Cluster_12(structuraldesign_0=structdsg)  # -> structuraldesign_1, forcediagram_1
flt_mvvecscl = X(Slider(1.5, range=0..10))
data = Data(cluster.forcediagram_1)
move = Move(Motion=Vector(0, 0, 10))  # -> Geometry, Transform
data_2 = Data(cluster.forcediagram_1)
data_3 = Data(cluster.structuraldesign_1)
data_4 = Data(data_3)
data_5 = Data(data_3)
python = PythonScript(CGHDtaStruct=data_3)  # -> out, RGPtsL_Vertices, RGPtsPairL_EdgesEndPts, RGLnsL_Edges, RGPtsLL_FacesVertices, RGPtsPllns_FacesOtlns
# ---------- python: Python ----------
from compas_ghc.Utilities.PythonGrasshopperIterables import NestedListToGrasshopperDataTree as NstdLstToGHDtaTr
if CGHDtaStruct is not None:
    print (CGHDtaStruct.__class__.__name__)
    _bool_ExclExt = True if CGHDtaStruct.__class__.__name__ == 'CGHFormDiagram' else False

    _dctVerticesDta = CGHDtaStruct.RetrieveFullVerticesData(    bool_ExclExt=_bool_ExclExt, 
                                                                bool_Keys=True, 
                                                                bool_Ind=True, 
                                                                bool_Coords=True, 
                                                                bool_DrawRG=True)
    _dctEdgesDta = CGHDtaStruct.RetrieveFullEdgesData(          bool_ExclExt=_bool_ExclExt, 
                                                                bool_Key=True, 
                                                                bool_Ind=True, 
                                                                bool_Coords=True, 
                                                                bool_DrawRGPts=True, 
                                                                bool_DrawRGLns=True)
    _dctFacesDta = CGHDtaStruct.RetrieveFullFacesData(          bool_ExclExt=_bool_ExclExt, 
                                                                bool_Key=True, 
                                                                bool_Ind=True, 
                                                                bool_Coords=True, 
                                                                bool_DrawRGPts=True, 
                                                                bool_DrawRGPLns=True, 
                                                                bool_Coords_FaceCnts=False, 
                                                                bool_DrawRGPts_FaceCnts=False)
                                                            
    RGPtsL_Vertices         = _dctVerticesDta['RGs']
    RGPtsPairL_EdgesEndPts  = NstdLstToGHDtaTr(_dctEdgesDta['RGs']['pts'])
    RGLnsL_Edges            = _dctEdgesDta['RGs']['lns']
    RGPtsLL_FacesVertices   = NstdLstToGHDtaTr(_dctFacesDta['RGs']['pts'][0])
    RGPtsPllns_FacesOtlns   = _dctFacesDta['RGs']['plns']
# ---------- end python ----------
python_2 = PythonScript(CGHDtaStruct=data_3)  # -> out, flt_AvgFaceAr
# ---------- python_2: Python ----------
iL_AnchorVKeysInds  = CGHDtaStruct.Anchors(bool_ExclExt=True, bool_Ind=True)

n_Faces = CGHDtaStruct.number_of_faces()
if n_Faces > 0:
    fltL_FaceArs    = [CGHDtaStruct.face_area(_fK) for _fK in CGHDtaStruct.FaceKeys()]
    flt_AvgFaceAr   = sum(fltL_FaceArs) / n_Faces
# ---------- end python_2 ----------
python_3 = PythonScript(CGHDtaStruct=data_3)  # -> out, fltsL_VerticesLds, RGVecsL_VerticesLds, fltsL_VerticesResidFcs, fltsL_EdgesFcs, fltsL_EdgesFcs_2, fltsL_EdgesLgths, fltsL_EdgesQs, eKeysL, fltsL_EdgesAngDevns
# ---------- python_3: Python ----------
from compas_ghc.Utilities.PythonGrasshopperIterables    import NestedListToGrasshopperDataTree as NstdLstToGHDtaTr
from compas_ghc.Utilities.RCGeometriesDrawers           import RGPointDrawers
from Rhino import Geometry as RG
if CGHDtaStruct is not None:
    [fltsL_EdgesFcs, fltsL_EdgesLgths, fltsL_EdgesQs, fltsL_EdgesAngDevns], eKeysL = CGHDtaStruct.RetrieveEdgeData(strsL_AttrNms=['f','l','q', 'a'], bool_RtnDtaLL = True, bool_RtnKeysLst=True)
    fltsL_VerticesResidFcs = CGHDtaStruct.RetrieveVertexData(strsL_AttrNms=['fR'], bool_RtnDtaLL = True)
    vecsL_VerticesLds = CGHDtaStruct.get_vertices_attributes(names=['px','py','pz'], keys=CGHDtaStruct.VertexKeys())
    RGVecsL_VerticesLds = [RG.Vector3d(*_vec) for _vec in vecsL_VerticesLds]
# ---------- end python_3 ----------
cluster_2 = Cluster_13(formdiag=data_5)  # -> pts, vertexkeys, edgekeys, stredgekeys, stredgekeys_2, faceverticeskeys, strfaceverticeskeys
python_4 = PythonScript(CGHDtaStruct=data_3)  # -> out, iL_AnchorVKeysInds
# ---------- python_4: Python ----------
iL_AnchorVKeysInds  = CGHDtaStruct.Anchors(bool_ExclExt=True, bool_Ind=True)
# ---------- end python_4 ----------
sqrt = SquareRoot(Value=python_2.flt_AvgFaceAr)
int = Integer(Slider(2, range=0..10))
num = Number(sqrt)
num_2 = Number(python_2.flt_AvgFaceAr)
S = Search(txt)
pt = Point(python.RGPtsL_Vertices)
crv = Curve(python.RGLnsL_Edges)
crv_2 = Curve(crv)
txt_4 = Text(int)
curvepoint = PointOnCurve(crv_2, parameter=0.5)
pt_2 = Point(cluster_2.pts)
txt_5 = Text(cluster_2.vertexkeys)
vec = Vector(python_3.RGVecsL_VerticesLds)
txt_6 = Text(cluster_2.stredgekeys)
num_3 = Number(python_3.fltsL_VerticesResidFcs)
num_4 = Number(python_3.fltsL_EdgesAngDevns)
txt_7 = Text(cluster_2.strfaceverticeskeys)
num_5 = Number(python_3.fltsL_EdgesFcs_2)
txt_8 = Text(python_3.eKeysL)
int_2 = Integer(python_4.iL_AnchorVKeysInds)
S_2 = Search(S)
crv_3 = Curve(crv)
lng = ListLength(List=txt_6)
P = Point(curvepoint)
P_2 = Point(pt)
P_3 = Point(P_2)
group = Group(Objects=P_3)
bbox = BoundingBox(Content=group, Plane=PlaneXY(0, 0, 0))  # -> Box, Box_2
debox = DeconstructBox(Box=bbox.Box)  # -> Plane, X, Y, Z
dedomain = DeconstructDomain(Domain=debox.X)  # -> Start, End
dedomain_2 = DeconstructDomain(Domain=debox.Y)  # -> Start, End
int_3 = Integer(dedomain.End)
int_4 = Integer(dedomain_2.End)
pt_3 = ConstructPoint(XCoordinate=int_3, YCoordinate=0, ZCoordinate=0)
vec_2 = Vector(pt_3)
python_5 = PythonScript(cDtaStruct=data, vec_Mv=vec_2, flt_MvVecScl=flt_mvvecscl)  # -> cDtaStruct_Mvd; inputs vec_Mv: Vector3d
# ---------- python_5: Python ----------
from compas.geometry.average import centroid_points
from compas.geometry.transformations import rotate_points

cDtaStruct_Mvd = cDtaStruct.CreateDuplicate()

vec_MvScld = [_cnpt * flt_MvVecScl for _cnpt in vec_Mv]

coordsL_Vertices = []
for _v, _attr in cDtaStruct_Mvd.vertex.items():
    _attr['x'] += vec_MvScld[0]
    _attr['y'] += vec_MvScld[1]
    _attr['z'] += vec_MvScld[2]
    coordsL_Vertices.append([ _attr['x'], _attr['y'], _attr['z']])

from math import pi
coords_VerticesCntr = centroid_points(coordsL_Vertices)
coordsL_PtsRotd     = rotate_points(coordsL_Vertices, pi/2, origin = coords_VerticesCntr)

_i = 0
for _v, _attr in cDtaStruct_Mvd.vertex.items():
    _attr['x'] = coordsL_PtsRotd[_i][0]
    _attr['y'] = coordsL_PtsRotd[_i][1]
    _attr['z'] = coordsL_PtsRotd[_i][2]
    _i += 1
# ---------- end python_5 ----------
data_6 = Data(python_5)
data_7 = Data(data_6)
data_8 = Data(data_7)
data_9 = Data(data_7)
python_6 = PythonScript(CGHForceDiag=data_8, CGHFormDiag=data_4)  # -> out, RGPtsL_Vertices, RGPtsPairL_EdgesEndPts, RGLnsL_Edges, strEKeysL_Edges, strEDualInds_Edges, RGPtsLL_FacesVertices, RGPtsPllns_FacesOtlns, strFKeysL_Faces
# ---------- python_6: Python ----------
from compas_ghc.Utilities.PythonGrasshopperIterables import NestedListToGrasshopperDataTree as NstdLstToGHDtaTr
if CGHForceDiag is not None:
    print (CGHForceDiag.__class__.__name__)
    _bool_ExclExt = False

    _dctVerticesDta = CGHForceDiag.RetrieveFullVerticesData(    bool_ExclExt=_bool_ExclExt, 
                                                                bool_Keys=True, 
                                                                bool_Ind=True, 
                                                                bool_Coords=True, 
                                                                bool_DrawRG=True)
    _dctEdgesDta = CGHForceDiag.RetrieveFullEdgesData(          bool_ExclExt=_bool_ExclExt, 
                                                                bool_Key=True, 
                                                                bool_Ind=True, 
                                                                bool_Coords=True, 
                                                                bool_DrawRGPts=True, 
                                                                bool_DrawRGLns=True)
    _dctFacesDta = CGHForceDiag.RetrieveFullFacesData(          bool_ExclExt=_bool_ExclExt, 
                                                                bool_Key=True, 
                                                                bool_Ind=True, 
                                                                bool_Coords=True, 
                                                                bool_DrawRGPts=True, 
                                                                bool_DrawRGPLns=True, 
                                                                bool_Coords_FaceCnts=False, 
                                                                bool_DrawRGPts_FaceCnts=False)
                                                            
    RGPtsL_Vertices                 = _dctVerticesDta['RGs']
    RGPtsPairL_EdgesEndPts          = NstdLstToGHDtaTr(_dctEdgesDta['RGs']['pts'])
    RGLnsL_Edges                    = _dctEdgesDta['RGs']['lns']
    eKeysL_Edges                    = _dctEdgesDta['keys']
    strEKeysL_Edges                 = [str(_eKey) for _eKey in eKeysL_Edges]
    RGPtsLL_FacesVertices           = NstdLstToGHDtaTr(_dctFacesDta['RGs']['pts'][0])
    RGPtsPllns_FacesOtlns           = _dctFacesDta['RGs']['plns']
    strFKeysL_Faces                 = _dctFacesDta['keys'][0]

    print len(CGHFormDiag.EdgeKeys())
    _dctMap_EKey_to_DualEKeyI      = CGHForceDiag.EKeyUVToDualEIndex(CGHFormDiag)
#    print _dctMap_EKey_to_DualEKeyI
    strEDualInds_Edges = []
    for _eKey in eKeysL_Edges:
        if _eKey not in _dctMap_EKey_to_DualEKeyI.keys():
            _dualERef = ''
        else:
            _dualERef = str(_dctMap_EKey_to_DualEKeyI[_eKey])
        strEDualInds_Edges.append(_dualERef)
# ---------- end python_6 ----------
pt_4 = Point(python_6.RGPtsL_Vertices)
crv_4 = Curve(python_6.RGLnsL_Edges)
txt_9 = Text(python_6.strEKeysL_Edges)
txt_10 = Text(python_6.strFKeysL_Faces)
txt_11 = Text(python_6.strEDualInds_Edges)
crv_5 = Curve(python_6.RGPtsPllns_FacesOtlns)
pt_5 = Point(python_6.RGPtsLL_FacesVertices)
int_5 = Integer(txt_2)
crv_6 = Curve(crv_4)
txt_12 = Text(txt_11)
panel = Panel(cluster_2.stredgekeys_2)
crv_7 = Curve(crv_5)
series = Series(Start=0, Step=1, Count=lng)
K = Keys(crv_3)
K_2 = Keys(crv_3)
txt_13 = Text(int_5)
S_3 = Search(txt_13)
K_3 = Keys(crv_6)
V = Values(txt_5)
V_2 = Values(txt_12)
K_4 = Keys(pt_2)
S_4 = Search(S_2)
S_5 = Search(txt_13)
txt_14 = Text(int_5)
S_6 = Search(txt_14)
crv_8 = Curve(crv_4)
V_3 = Values(txt_10)
K_5 = Keys(crv_7)
S_7 = Search(S_2)
T = Text(txt_11)
S_8 = Size(Slider(0.06, range=0..1))
int_6 = Integer(series)
txt_15 = Text(int_6)
V_4 = Values(txt_15)
V_5 = Values(txt_15)
curvepoint_2 = PointOnCurve(crv_8, parameter=0.5)
keysearch = KeyValueSearch(Keys=V, Values=K_4, Search=S_4)
keysearch_2 = KeyValueSearch(Keys=V_4, Values=K, Search=S_3)
keysearch_3 = KeyValueSearch(Keys=V_3, Values=K_5, Search=S_7)
keysearch_4 = KeyValueSearch(Keys=V_2, Values=K_3, Search=S_6)
keysearch_5 = KeyValueSearch(Keys=V_5, Values=K_2, Search=S_5)
txt_16 = Text(int_6)
int_7 = Integer(int_6)
panel_2 = Panel(txt_8)
S_9 = Search(keysearch)
S_10 = Search(keysearch_3)
tag = TextTag3D(Location=curvepoint_2, Text=T, Size=S_8, Justification=5)
srf = Surface(S_10)
C = Curve(keysearch_2)
R = Radius(Slider(0.13, range=0..1))
C_2 = Curve(keysearch_4)
R_2 = Radius(Slider(0.13, range=0..1))
sph = Sphere(Base=S_9, Radius=Slider(0.2, range=0..1))
pipe = Pipe(Curve=C, Radius=R, Caps=0)
pipe_2 = Pipe(Curve=C_2, Radius=R_2, Caps=0)
preview = CustomPreview(
    Geometry=sph,
    Shader={ambient=RGB(0, 0, 0), diffuse=RGB(255, 105, 180), emission=RGB(76, 32, 54), shine=0.5, specular=RGB(255, 255, 255), transparency=0})
preview_2 = CustomPreview(
    Geometry=srf,
    Shader={ambient=RGB(0, 0, 0), diffuse=RGB(255, 105, 180), emission=RGB(76, 32, 54), shine=0.5, specular=RGB(255, 255, 255), transparency=0})
previewlw = CustomPreviewLineweights(
    Geometry=[C_2, C],
    Shader={ambient=RGB(0, 0, 0), diffuse=RGB(255, 105, 180), emission=RGB(76, 32, 54), shine=0.5, specular=RGB(255, 255, 255), transparency=0},
    Thickness=Slider(10, range=0..10),
    Absolute=False)
num_6 = Number(num_5)
abs = Absolute(Value=num_6)
bnd = Bounds(Numbers=abs)
num_7 = Number(num)
dedomain_3 = DeconstructDomain(Domain=bnd)  # -> Start, End
num_8 = Number(num_7)
txt_17 = Text(txt_5)
num_9 = Number(Slider(2, range=0..10))
txt_18 = Text(txt_5)
P_4 = Point(P_2)
num_10 = Number(num_4)
num_11 = Number(num_7)
num_12 = Number(Slider(50, range=0..100))
P_5 = Point(P)
num_13 = Number(num_7)
num_14 = Number(Slider(75, range=0..100))
num_15 = Number(num_3)
num_16 = Number(dedomain_3.End)
num_17 = Number(num_5)
crv_9 = Curve(crv)
pt_6 = Point(P)
num_18 = Number(Slider(2, range=0..10))
txt_19 = Text(txt_6)
txt_20 = Text(txt_16)
num_19 = Number(num_7)
vec_3 = Vector(vec)
num_20 = Number(num_7)
division = Division(A=num_15, B=num_16)
vec_4 = Vector(vec_3)
num_21 = Number(division)
vlen = VectorLength(Vector=vec_4)
num_22 = Number(num_7)
num_23 = Number()
num_24 = Number(num_17)
num_25 = Number(Slider(1, range=0..100))
num_26 = Number(num_7)
num_27 = Number(num_17)
num_28 = Number(Slider(20, range=0..100))
num_29 = Number(Slider(4, range=0..100))
division_2 = Division(A=num_8, B=Slider(5, range=0..100))
crv_10 = Curve(crv_9)
division_3 = Division(A=num_19, B=Slider(12, range=0..100))
cluster_3 = Cluster_11(num=num_24, num_4=num_22, num_2=num_23, num_3=num_25)  # -> V_5, V_4, S_5
division_4 = Division(A=num_20, B=Slider(8, range=0..100))
cluster_4 = Cluster_11(num=num_27, num_4=num_26, num_2=num_28, num_3=num_29)  # -> V_5, V_4, S_5
num_30 = Number(Slider(1.5, range=0..100))
num_31 = Number(vlen)
num_32 = Number(num_7)
num_33 = Number(Slider(0.5, range=0..100))
A = Amplitude(Slider(1.5, range=0..10))
A_2 = Amplitude(Slider(2, range=0..10))
num_34 = Number(division_2)
cluster_5 = Cluster_11(num=num_31, num_4=num_32, num_2=num_33, num_3=num_30)  # -> V_5, V_4, S_5
num_35 = Number(division_3)
num_36 = Number(num_12)
num_37 = Number(Slider(1, range=0..100))
num_38 = Number(num_11)
P_6 = Point(P_4)
num_39 = Number(num_14)
num_40 = Number(division_4)
num_41 = Number(num_13)
P_7 = Point(P_5)
l0 = LowerLimit("1")
l0_2 = LowerLimit(num_21)
l0_3 = LowerLimit("0")
l0_4 = LowerLimit("180")
l0_5 = LowerLimit(num_10)
l0_6 = LowerLimit("0")
curvepoint_3 = PointOnCurve(crv_10, parameter=0.5)
P_8 = Point(P_2)
int_8 = Integer(int_2)
end = EndPoints(Curve=crv_10)  # -> Start, End
bool_2 = Boolean(Toggle(True))
num_42 = Number(num_7)
num_43 = Number(num_37)
gradient = Gradient(LowerLimit=l0_3, UpperLimit=l0, Parameter=l0_2, stops=[0: RGB(19, 148, 58), 0.0508: RGB(255, 255, 0), 1: RGB(255, 0, 0)])
division_5 = Division(A=num_38, B=num_36)
gradient_2 = Gradient(
    LowerLimit=l0_6,
    UpperLimit=l0_4,
    Parameter=l0_5,
    stops=[0: RGB(19, 148, 58), 0.0786: RGB(255, 255, 0), 1: RGB(255, 0, 0)])
division_6 = Division(A=num_41, B=num_39)
crv_11 = Curve(crv_9)
I = Domain(cluster_3.S_5)
V_6 = Value(cluster_3.V_5)
I_2 = Domain(cluster_4.S_5)
V_7 = Value(cluster_3.V_4)
V_8 = Value(cluster_4.V_5)
V_9 = Value(cluster_4.V_4)
vec2pt = Vector2Pt(PointA=end.Start, PointB=end.End, Unitize=bool_2)  # -> Vector, Length
Z = UnitZ(Factor=1)
division_7 = Division(A=num_42, B=num_43)
len = Length(Curve=crv_11)
dedomain_4 = DeconstructDomain(Domain=I)  # -> Start, End
num_44 = Number(division_5)
num_45 = Number(division_6)
V_10 = Value(cluster_5.V_5)
vec_5 = Vector(vec2pt.Vector)
L = List(P_8)
i = Index(int_8)
num_46 = Number(division_7)
division_8 = Division(A=len, B="2")
xprod = CrossProduct(VectorA=vec_5, VectorB=Z, Unitize=False)  # -> Vector, Length
item = ListItem(List=L, Index=i, Wrap=True)
num_47 = Number(dedomain_4.End)
num_48 = Number(num_44)
num_49 = Number(num_45)
num_50 = Number(V_8)
num_51 = Number(division_8)
vec_6 = Vector(xprod.Vector)
A_3 = Amplitude(V_10)
C_3 = Colour(gradient)
neg = Negative(Value=num_47)
C_4 = Colour(gradient_2)
vec_7 = Vector(vec_3)
P_9 = Point(P_2)
A_4 = Amplitude(A)
pt_7 = Point(item)
A_5 = Amplitude(A_2)
dom = ConstructDomain(DomainStart=expr("x*-1", num_50), DomainEnd=num_50)
dom_2 = ConstructDomain(DomainStart=expr("x*-1", num_51), DomainEnd=num_51)
xprod_2 = CrossProduct(VectorA=vec_5, VectorB=vec_6, Unitize=False)  # -> Vector, Length
amp = Amplitude(Vector=vec_7, Amplitude=A_3)
num_52 = Number(V_7)
num_53 = Number(neg)
T_2 = Text()
num_54 = Number(num_48)
L_2 = Location(P_6)
T_3 = Text()
num_55 = Number(num_49)
L_3 = Location(P_7)
num_56 = Number(num_46)
C_5 = Colour(C_3)
num_57 = Number(num_46)
C_6 = Colour(C_4)
vec_8 = Vector(xprod_2.Vector)
vec_9 = Vector(amp)
gradient_3 = Gradient(
    LowerLimit=num_53,
    UpperLimit=num_47,
    Parameter=num_52,
    stops=[0: RGB(234, 38, 0), 0.441: RGB(234, 126, 0), 0.5: RGB(254, 244, 84), 0.57: RGB(173, 203, 249), 1: RGB(75, 107, 169)])
Z_2 = UnitZ(Factor=num_54)
dom_3 = ConstructDomain(DomainStart=expr("x*-1", num_57), DomainEnd="0")
dom_4 = ConstructDomain(DomainStart=expr("x*-1", num_56), DomainEnd=num_56)
Z_3 = UnitZ(Factor=num_55)
neg_2 = Negative(Value=vec_9)
num_58 = Number(num_9)
T_4 = Text(txt_17)
num_59 = Number(num_34)
vec_10 = Vector(vec_6)
vec_11 = Vector(vec_5)
O = Origin(curvepoint_3)
move_2 = Move(Geometry=L_2, Motion=Z_2)  # -> Geometry, Transform
multiplication = Multiplication(A=neg_2, B=A_4)
move_3 = Move(Geometry=L_3, Motion=Z_3)  # -> Geometry, Transform
X = X(dom_3)
X_2 = X(dom_4)
num_60 = Number(num_18)
T_5 = Text(txt_19)
num_61 = Number(num_35)
num_62 = Number(num_18)
multiplication_2 = Multiplication(A=num_59, B=num_58)
txt_21 = Text(txt_20)
num_63 = Number(num_40)
vec_12 = Vector(multiplication)
L_4 = Location(P_4)
Z_4 = UnitZ(Factor=1)
pl = ConstructPlane(Origin=O, XAxis=vec_11, YAxis=vec_10)
pt_8 = Point(move_2.Geometry)
multiplication_3 = Multiplication(A=num_61, B=num_60)
multiplication_4 = Multiplication(A=num_63, B=num_62)
pt_9 = Point(move_3.Geometry)
move_4 = Move(Geometry=P_9, Motion=vec_12)  # -> Geometry, Transform
amp_2 = Amplitude(Vector=Z_4, Amplitude=multiplication_2)
B = Base(pt_7)
Y = Y(X_2)
B_2 = Base(pl)
X_3 = X(X_2)
Z_5 = Z(X)
Z_6 = Z(dom)
X_4 = X(dom_2)
Y_2 = Y(dom)
data_10 = Data(gradient_3)
S_11 = Shader(gradient_3)
P_10 = Point(move_4.Geometry)
V_11 = Value(V_10)
move_5 = Move(Geometry=L_4, Motion=amp_2)  # -> Geometry, Transform
L_5 = Location(pt_6)
L_6 = Location(pt_6)
box = DomainBox(Base=B, X=X_3, Y=Y, Z=Z_5)
box_2 = DomainBox(Base=B_2, X=X_4, Y=Y_2, Z=Z_6)
multiplication_5 = Multiplication(A=V_11, B=A_5)
Z_7 = UnitZ(Factor=1)
Z_8 = UnitZ(Factor=1)
l0_7 = LowerLimit(num_21)  # disabled
V_12 = Value(multiplication_5)
l0_8 = LowerLimit(num_10)  # disabled
S_12 = Shader(S_11)
G = Geometry(box_2)
tag_2 = TextTag3D(Location=move_5.Geometry, Text=T_4, Size=num_59, Justification=5)
amp_3 = Amplitude(Vector=Z_7, Amplitude=multiplication_4)
amp_4 = Amplitude(Vector=Z_8, Amplitude=multiplication_3)
material = CreateMaterial(Diffuse=data_10, Specular=data_10, Emission=data_10, Transparency=Slider(0.25, range=0..1), Shine=0)
int_9 = Integer(l0_7)  # disabled
int_10 = Integer(l0_8)  # disabled
C_7 = Colour(C_5)  # disabled
pt_10 = Point(pt_8)  # disabled
pt_11 = Point(pt_8)
C_8 = Colour(C_5)
C_9 = Colour(C_6)  # disabled
pt_12 = Point(pt_9)  # disabled
pt_13 = Point(pt_9)
C_10 = Colour(C_6)
preview_3 = CustomPreview(Geometry=box, Shader=ColourSwatch(SwatchColor=RGB(0, 204, 102)))
tag_3 = TextTag(Location=pt_10, Text=int_9, Colour=C_7)  # disabled
move_6 = Move(Geometry=L_5, Motion=amp_3)  # -> Geometry, Transform
dots = DotDisplay(Point=pt_11, Colour=C_8, Size=num_54)
move_7 = Move(Geometry=L_6, Motion=amp_4)  # -> Geometry, Transform
tag_4 = TextTag(Location=pt_12, Text=int_10, Colour=C_9)  # disabled
dots_2 = DotDisplay(Point=pt_13, Colour=C_10, Size=num_55)
vdisex = VectorDisplayEx(Point=P_10, Vector=vec_9, Colour=ColourSwatch(SwatchColor=RGB(255, 10, 88)), Width=V_12)
tag_5 = TextTag3D(Location=move_6.Geometry, Text=txt_21, Size=num_63, Justification=5)
tag_6 = TextTag3D(Location=move_7.Geometry, Text=T_5, Size=num_61, Justification=5)
preview_4 = CustomPreview(Geometry=G, Shader=material)

# ==== cluster ForceDensitySolver
structuraldesign_⓿ = ClusterInput()
data = Data(structuraldesign_⓿)
python = PythonScript(structDsg_0=data)  # -> out, structDsg_1, formDiag_1, fltsL_Fcs, fltsL_Lgths, fltsL_Qs, fltsL_Lds, RGVecsL_Lds, fltsL_ResidFcs, strsL_ErrMsgs
# ---------- python: Python ----------
from compas_ghc.Utilities.InputsOutputsProcessing       import GrasshopperInputsGate
from compas_ghc.Utilities.InputsOutputsProcessing       import SetDefaultInput as SetDfltInp
from compas_ghc.DataStructures.CGHStructuralDesign      import CGHStructuralDesign as CGHStructDsg
from compas_ghc.Utilities.PythonGrasshopperIterables    import NestedListToGrasshopperDataTree as NstdLstToGHDtaTr
from Rhino import Geometry as RG
if GrasshopperInputsGate(structDsg_0, 'CGHStructuralDesign'):
    from compas.rpc import Proxy
    _FDM = Proxy('compas_ghc.StructuralSolvers.FDM.fdm')
#    _FDM.stop_server()
#    _FDM = Proxy('compas_ghc.StructuralSolvers.FDM.fdm')
    
    from compas_ghc.DataStructures.CGHDiagrams import CGHFormDiagram
    
    _structDsg_0 = structDsg_0.CreateDuplicate()
    _formDiag = structDsg_0.formDiag
    
    _flt_TtlSWLd = -1 * structDsg_0.vec_GblArLd[2]
    _structDsg_1 = CGHStructDsg()
   
    _formData_0 = structDsg_0.formDiag.to_data()
    _formData_1, _cDctStructSolvOprDta= _FDM.ForceDensitySolver(_formData_0, _flt_TtlSWLd, bool_LdsRdistrByTrib = True, iMax_LdsRedistr = 5)
    _formDiag_1 = CGHFormDiagram.from_data(_formData_1)
    _structDsg_0.SetFormDiagram(_formDiag_1)
    
    formDiag_1  = _formDiag_1
    structDsg_1 = _structDsg_0
    
    _eKeysL = formDiag_1.EdgeKeys()
    _vKeysL = formDiag_1.VertexKeys()
    _structSolvEdgeDta = formDiag_1.get_edges_attributes(names=['f','l','q'], keys=_eKeysL)
    
    fltsL_ResidFcs = formDiag_1.get_vertices_attribute(name='fResid', keys=_vKeysL)
    vecsL_Lds = formDiag_1.get_vertices_attributes(names=['px','py','pz'], keys=_vKeysL)
    
    fltsL_Fcs, fltsL_Lgths, fltsL_Qs = [[_structSolvEdgeDta[_v][_iAttr] for _v in range(0, len(_eKeysL))] for _iAttr in range(0,3)]
    RGVecsL_Lds = [RG.Vector3d(_vec[0], _vec[1], _vec[2]) for _vec in vecsL_Lds]
# ---------- end python ----------
trim = TrimTree(Tree=python.fltsL_Lds, Depth=1)
data_2 = Data(python.structDsg_1)
data_3 = Data(python.fltsL_Fcs)
data_4 = Data(python.fltsL_Lgths)
data_5 = Data(python.formDiag_1)
data_6 = Data(python.fltsL_ResidFcs)
data_7 = Data(python.fltsL_Qs)
data_8 = Data(python.RGVecsL_Lds)
structuraldesign_➊ = ClusterOutput(data_2)
lengths_➊ = ClusterOutput(data_4)
loads_➊ = ClusterOutput(data_8)
residual_forces_➊ = ClusterOutput(data_6)
forcediagram_➊ = ClusterOutput(data_5)
forces_➊ = ClusterOutput(data_3)
forcedensities_➊ = ClusterOutput(data_7)

# ==== cluster Cluster_15
showhidden = ClusterInput()
bool = Boolean(showhidden)

# ---- group: Deconstruct Geometry
formdiag = ClusterInput()

# ----
python = PythonScript(CGHDtaStruct=formdiag, bool_InclExt=bool)  # -> out, RGPtsL_Vertices, RGPtsPairL_EdgesEndPts, RGLnsL_Edges, RGPtsLL_FacesVertices, RGPtsPllns_FacesOtlns; inputs bool_InclExt: Boolean
# ---------- python: Python ----------
from compas_ghc.Utilities.PythonGrasshopperIterables import NestedListToGrasshopperDataTree as NstdLstToGHDtaTr
if CGHDtaStruct is not None:
    _CGHDtaStruct = CGHDtaStruct.CreateDuplicate()
    _bool_ExclExt = True if CGHDtaStruct.__class__.__name__ == 'CGHFormDiagram' else False
    _bool_ExclExt = not bool_InclExt if bool_InclExt is not None else _bool_ExclExt

    _dctVerticesDta = _CGHDtaStruct.RetrieveFullVerticesData(   bool_ExclExt=_bool_ExclExt, 
                                                                bool_Keys=True, 
                                                                bool_Ind=True, 
                                                                bool_Coords=True, 
                                                                bool_DrawRG=True)
    _dctEdgesDta = _CGHDtaStruct.RetrieveFullEdgesData(          bool_ExclExt=_bool_ExclExt, 
                                                                bool_Key=True, 
                                                                bool_Ind=True, 
                                                                bool_Coords=True, 
                                                                bool_DrawRGPts=True, 
                                                                bool_DrawRGLns=True)
    _dctFacesDta = _CGHDtaStruct.RetrieveFullFacesData(          bool_ExclExt=_bool_ExclExt, 
                                                                bool_Key=True, 
                                                                bool_Ind=True, 
                                                                bool_Coords=True, 
                                                                bool_DrawRGPts=True, 
                                                                bool_DrawRGPLns=True, 
                                                                bool_Coords_FaceCnts=False, 
                                                                bool_DrawRGPts_FaceCnts=False)
                                                            
    RGPtsL_Vertices         = _dctVerticesDta['RGs']
    RGPtsPairL_EdgesEndPts  = NstdLstToGHDtaTr(_dctEdgesDta['RGs']['pts'])
    RGLnsL_Edges            = _dctEdgesDta['RGs']['lns']
    RGPtsLL_FacesVertices   = NstdLstToGHDtaTr(_dctFacesDta['RGs']['pts'][0])
    RGPtsPllns_FacesOtlns   = _dctFacesDta['RGs']['plns']
# ---------- end python ----------
trim = TrimTree(Tree=python.RGPtsLL_FacesVertices, Depth=1)
trim_2 = TrimTree(Tree=python.RGPtsPairL_EdgesEndPts, Depth=1)

# ---- group: Deconstruct Geometry (continued)
faces_asendpts = ClusterOutput(trim)
faces_aspolylines = ClusterOutput(python.RGPtsPllns_FacesOtlns)
edges_asendpts = ClusterOutput(trim_2)
pts = ClusterOutput(python.RGPtsL_Vertices)
edges_aslines = ClusterOutput(python.RGLnsL_Edges)

# ==== cluster Cluster_16
formdiag = ClusterInput()
python_script = PythonScript(CGHDtaStruct=formdiag)  # -> out, RGPtsL_Vertices, vKeysIL_Vertices, eKeysIL_Edges, vKeysILL_FaceVertices
# ---------- python_script: Python ----------
from compas_ghc.Utilities.PythonGrasshopperIterables import NestedListToGrasshopperDataTree as NstdLstToGHDtaTr
if CGHDtaStruct is not None:
    print (CGHDtaStruct.__class__.__name__)
    _bool_ExclExt = True if CGHDtaStruct.__class__.__name__ == 'CGHFormDiagram' else False

    _dctVerticesDta = CGHDtaStruct.RetrieveFullVerticesData(    bool_ExclExt=_bool_ExclExt, 
                                                                bool_Keys=True, 
                                                                bool_Ind=True, 
                                                                bool_Coords=True, 
                                                                bool_DrawRG=True)
    _dctEdgesDta = CGHDtaStruct.RetrieveFullEdgesData(          bool_ExclExt=_bool_ExclExt, 
                                                                bool_Key=True, 
                                                                bool_Ind=True, 
                                                                bool_Coords=True, 
                                                                bool_DrawRGPts=True, 
                                                                bool_DrawRGLns=True)
    _dctFacesDta = CGHDtaStruct.RetrieveFullFacesData(          bool_ExclExt=_bool_ExclExt, 
                                                                bool_Key=True, 
                                                                bool_Ind=True, 
                                                                bool_Coords=True, 
                                                                bool_DrawRGPts=True, 
                                                                bool_DrawRGPLns=True, 
                                                                bool_Coords_FaceCnts=False, 
                                                                bool_DrawRGPts_FaceCnts=False)
                                                            
    RGPtsL_Vertices         = _dctVerticesDta['RGs']
    vKeysIL_Vertices        = _dctVerticesDta['inds']
    eKeysIL_Edges           = NstdLstToGHDtaTr([list(_eKeyI) for _eKeyI in _dctEdgesDta['inds']])
    vKeysILL_FaceVertices   = NstdLstToGHDtaTr(_dctFacesDta['inds'][1])
# ---------- end python_script ----------
trim_tree = TrimTree(Tree=python_script.eKeysIL_Edges, Depth=1)
trim_tree_2 = TrimTree(Tree=python_script.vKeysILL_FaceVertices, Depth=1)
integer = Integer(trim_tree_2)
integer_2 = Integer(python_script.vKeysIL_Vertices)
integer_3 = Integer(trim_tree)
edgekeys = ClusterOutput(integer_3)
vertexkeys = ClusterOutput(integer_2)
faceverticeskeys = ClusterOutput(integer)
pts = ClusterOutput(python_script.RGPtsL_Vertices)

# ==== cluster Cluster_2
data = ClusterInput()
pt = ClusterInput()

# ---- group: Find indices of points
data_2 = Data(data)
python = PythonScript(infoL_Anchs=data_2)  # -> iL_Anchs, rgPtsL_Anchs; inputs infoL_Anchs: list
# ---------- python: Python ----------
iL_Anchs = []
rgPtsL_Anchs = []
for _info_Anch in infoL_Anchs:
    _typ = str(type(_info_Anch))
    print _typ
    if _typ == "<type 'Point3d'>":
        rgPtsL_Anchs.append(_info_Anch)
        
    elif _typ == "<type 'str'>" or _typ == "<type 'str'>":
        try:
            _i = int(_info_Anch)
            iL_Anchs.append(_info_Anch)
        except:
            pass
# ---------- end python ----------
pt_2 = Point(pt)
pt_3 = Point(python.rgPtsL_Anchs)
pt_4 = Point(pt_3)
cp = ClosestPoint(Point=pt_4, Cloud=pt_2)  # -> ClosestPoint, CPIndex, Distance
int = Integer(python.iL_Anchs)
int_2 = Integer(cp.CPIndex)
merge = Merge(Data1=int, Data2=int_2)
cset = CreateSet(List=merge)  # -> Set, Map
int_3 = Integer(cset.Set)

# ----
tstat = TreeStatistics(Tree=pt_2)  # -> Paths, Length, Count; disabled
panel = Panel(tstat.Paths)  # disabled

int_4 = ClusterOutput(int_3)

# ==== cluster Cluster_11
num = ClusterInput()
num_2 = ClusterInput()
num_3 = ClusterInput()
num_4 = ClusterInput()
num_5 = Number(num)
num_6 = Number(num_2)
abs = Absolute(Value=num_5)
num_7 = Number(num_3)
num_8 = Number(num_4)
num_9 = Number(abs)
division = Division(A=num_8, B=num_6)
division_2 = Division(A=num_8, B=num_7)
bnd = Bounds(Numbers=num_9)
dedomain = DeconstructDomain(Domain=bnd)  # -> Start, End
python = PythonScript(x=num_6, y=division, z=dedomain.Start)  # -> a, b
# ---------- python: Python ----------
if x == None:
    a=0
    b=0
else:
    a=y
    b=z
# ---------- end python ----------
dom = ConstructDomain(DomainStart=python.a, DomainEnd=division_2)
dom_2 = ConstructDomain(DomainStart=python.b, DomainEnd=dedomain.End)
python_2 = PythonScript(fltsL=num_5)  # -> sgnsL; inputs fltsL: list
# ---------- python_2: Python ----------
sgnsL = []
for _flt in fltsL:
    if abs(_flt)>0:
        _sgn = _flt/abs(_flt)
    else:
        _sgn = 0
    sgnsL.append(_sgn)
# ---------- end python_2 ----------
S = Source(dom_2)
V = Value(num_9)
S_2 = Source(dom)
S_3 = Source(S)
remap = RemapNumbers(Value=V, Source=S_3, Target=S_2)  # -> Mapped, Clipped
num_10 = Number(python_2)
multiplication = Multiplication(A=num_10, B=remap.Mapped)
V_2 = Value(remap.Mapped)
V_3 = Value(multiplication)
S_4 = Source(S_2)
V_4 = ClusterOutput(V_3)
V_5 = ClusterOutput(V_2)
S_5 = ClusterOutput(S_4)

# ==== cluster Cluster_12
structuraldesign_0 = ClusterInput()
createdualdiagram = PythonScript(structDsg_0=structuraldesign_0)  # -> formDiag, forceDiag
# ---------- createdualdiagram: Python ----------
from compas_ghc.Utilities.InputsOutputsProcessing import GrasshopperInputsGate

if GrasshopperInputsGate(structDsg_0, 'CGHStructuralDesign'):
    _structDsg_0    = structDsg_0
    
    _formDiag       = _structDsg_0.formDiag
    _forceDiag      = _structDsg_0.forceDiag
    
    formDiag        = _formDiag
    forceDiag       = _forceDiag
# ---------- end createdualdiagram ----------
structuraldesign_1 = ClusterOutput(createdualdiagram.formDiag)
forcediagram_1 = ClusterOutput(createdualdiagram.forceDiag)

# ==== cluster Cluster_13
formdiag = ClusterInput()
python_script = PythonScript(CGHDtaStruct=formdiag)  # -> out, RGPtsL_Vertices, vKeysIL_Vertices, eKeysIL_Edges, strEKeysIL_Edges, strEKeysL_Edges, vKeysILL_FaceVertices, strVKeysILL_FaceVertices
# ---------- python_script: Python ----------
from compas_ghc.Utilities.PythonGrasshopperIterables import NestedListToGrasshopperDataTree as NstdLstToGHDtaTr
from compas_ghc.Utilities.StringFormatting import ConcatenateValuesList as ConcatValsLst
if CGHDtaStruct is not None:
    print (CGHDtaStruct.__class__.__name__)
    _bool_ExclExt = True if CGHDtaStruct.__class__.__name__ == 'CGHFormDiagram' else False

    _dctVerticesDta = CGHDtaStruct.RetrieveFullVerticesData(    bool_ExclExt=_bool_ExclExt, 
                                                                bool_Keys=True, 
                                                                bool_Ind=True, 
                                                                bool_Coords=True, 
                                                                bool_DrawRG=True)
    _dctEdgesDta = CGHDtaStruct.RetrieveFullEdgesData(          bool_ExclExt=_bool_ExclExt, 
                                                                bool_Key=True, 
                                                                bool_Ind=True, 
                                                                bool_Coords=True, 
                                                                bool_DrawRGPts=True, 
                                                                bool_DrawRGLns=True)
    _dctFacesDta = CGHDtaStruct.RetrieveFullFacesData(          bool_ExclExt=_bool_ExclExt, 
                                                                bool_Key=True, 
                                                                bool_Ind=True, 
                                                                bool_Coords=True, 
                                                                bool_DrawRGPts=True, 
                                                                bool_DrawRGPLns=True, 
                                                                bool_Coords_FaceCnts=False, 
                                                                bool_DrawRGPts_FaceCnts=False)
                                                            
    RGPtsL_Vertices            = _dctVerticesDta['RGs']
    vKeysIL_Vertices           = _dctVerticesDta['inds']
    strEKeysL_Edges            = [str(_eKey) for _eKey in _dctEdgesDta['keys']]
    strEKeysIL_Edges           = [ConcatValsLst(_eKey) for _eKey in _dctEdgesDta['inds']]
    strVKeysILL_FaceVertices   = [ConcatValsLst(_vKeysL) for _vKeysL in _dctFacesDta['inds'][1]]
    eKeysIL_Edges           = NstdLstToGHDtaTr([list(_eKeyI) for _eKeyI in _dctEdgesDta['inds']])
    vKeysILL_FaceVertices   = NstdLstToGHDtaTr(_dctFacesDta['inds'][1])
# ---------- end python_script ----------
trim_tree = TrimTree(Tree=python_script.eKeysIL_Edges, Depth=1)
trim_tree_2 = TrimTree(Tree=python_script.vKeysILL_FaceVertices, Depth=1)
integer = Integer(python_script.vKeysIL_Vertices)
integer_2 = Integer(trim_tree)
txt = Text(python_script.strEKeysIL_Edges)
txt_2 = Text(python_script.strEKeysL_Edges)
txt_3 = Text(python_script.strVKeysILL_FaceVertices)
integer_3 = Integer(trim_tree_2)
vertexkeys = ClusterOutput(integer)
pts = ClusterOutput(python_script.RGPtsL_Vertices)
edgekeys = ClusterOutput(integer_2)
stredgekeys = ClusterOutput(txt)
stredgekeys_2 = ClusterOutput(txt_2)
faceverticeskeys = ClusterOutput(integer_3)
strfaceverticeskeys = ClusterOutput(txt_3)
