# Grasshopper definition test_rpc.gh (Grasshopper 0.9.76)
# plug-ins: Python Interpreter

python = PythonScript()  # -> out
# ---------- python: Python ----------
from compas.rpc import Proxy

_proxy = Proxy('compas_ghc.Utilities.RPCDummyFunction')
_proxy.stop_server()
_proxy = Proxy('compas_ghc.Utilities.RPCDummyFunction')

_dta = {0:1,1:2,2:3}
_dta2 = _proxy.RPCDummyFunction(_dta)

print _dta2
# ---------- end python ----------
panel = Panel(python)
