# Grasshopper definition MeshToRGMesh.gh (Grasshopper 0.9.76)
# plug-ins: Python Interpreter

python = PythonScript()  # -> out, RGMesh
# ---------- python: Python ----------
import Rhino as RC

def MeshToRGMesh(mesh):
    _RGMesh = RC.Geometry.Mesh()
    _vKeysL_Vertices            = list(mesh.vertex.keys())
    _coordsL_Vertices           = mesh.get_vertices_attributes(keys=_vKeysL_Vertices, names=['x','y','z']) 
    [_RGMesh.Vertices.Add(_coords[0],_coords[1],_coords[2]) for _coords in _coordsL_Vertices]

    _vKeysLL_FacesVertices      = [_vKsL for _fK, _vKsL in mesh.face.items()]
    [_RGMesh.Faces.AddFace(*_vKeysL) for _vKeysL in _vKeysLL_FacesVertices if len(_vKeysL) <= 4]

    return _RGMesh;


RGMesh = MeshToRGMesh(mesh)
# ---------- end python ----------
mesh = Mesh(python.RGMesh)
