# Grasshopper definition datatree_examples.gh (Grasshopper 0.9.76)
# plug-ins: Python Interpreter

panel = Panel("""1
2
3""")
panel_2 = Panel("""a
b
c""")
panel_3 = Panel("https://developer.rhino3d.com/guides/rhinopython/grasshopper-datatrees-and-python/")
line = Line(Line((0, 0, 0), (10, 10, 0)))
box = Box({Plane=PlaneXY(-17.38781117, -9.785726393, 0), X=Domain(0, 4.482602728), Y=Domain(0, 4.058462887), Z=Domain(0, 6.765692237)})
panel_4 = Panel("""Default
Layer 01""")
graft = GraftTree(Tree=[line, box], IncludeEmptyLists=True, IncludeNullItems=True)
int = Integer(panel)
graft_2 = GraftTree(Tree=panel_2, IncludeEmptyLists=True, IncludeNullItems=True)
graft_3 = GraftTree(Tree=int, IncludeEmptyLists=True, IncludeNullItems=True)
data = Data([graft_2, graft_3, graft])
panel_5 = Panel(data)
objsinlayers = GhPythonScript(layernames=panel_4)  # -> out, a; inputs layernames: list of String
# ---------- objsinlayers: Python ----------
import Rhino


# for accesssing GH classes
from Grasshopper.Kernel.Data import GH_Path
from Grasshopper import DataTree
import System.Array as array

layerTree = DataTree[object]() # make a DataTree
for i in range(len(layernames)):
    objs = Rhino.RhinoDoc.ActiveDoc.Objects.FindByLayer(layernames[i])
    
    if objs:
        geoms = [obj.Geometry for obj in objs]
        path = GH_Path(array[int]([0,0,i]))
        layerTree.AddRange(geoms, path)
        
a = layerTree
# ---------- end objsinlayers ----------
objsinlayers_th = GhPythonScript(layernames=panel_4)  # -> out, a; inputs layernames: list of String
# ---------- objsinlayers_th: Python ----------
import ghpythonlib.treehelpers as th
import Rhino

layerTree = []

for i in range(len(layernames)):
    objs = Rhino.RhinoDoc.ActiveDoc.Objects.FindByLayer(layernames[i])
    
    if objs:
        geoms = [obj.Geometry for obj in objs]
        layerTree.append(geoms)

layerTree = th.list_to_tree(layerTree, source=[0,0])
a = layerTree
# ---------- end objsinlayers_th ----------
explaintree_th = GhPythonScript(x=data)  # -> a; inputs x: tree
# ---------- explaintree_th: Python ----------
import ghpythonlib.treehelpers as th

x = th.tree_to_list(x)

a = []

for i,branch in enumerate(x):
    
    for j,item in enumerate(branch):
        s = str(i) + "[" + str(j) + "] "
        s += type(item).__name__ + ": "
        s += str(item)
        
        a.append(s)
# ---------- end explaintree_th ----------
explaintree = GhPythonScript(x=data)  # -> a; inputs x: tree
# ---------- explaintree: Python ----------
# (to access gh types - here not needed)
# from Grasshopper.Kernel.Data import GH_Path
# from Grasshopper import DataTree

a = []

for i in range(x.BranchCount):
    branchList = x.Branch(i)
    branchPath = x.Path(i)
    
    for j in range(branchList.Count):
        s = str(branchPath) + "[" + str(j) + "] "
        s += type(branchList[j]).__name__ + ": "
        s += str(branchList[j])
        
        a.append(s)
# ---------- end explaintree ----------
panel_6 = Panel(objsinlayers.a)
panel_7 = Panel(objsinlayers_th.a)
panel_8 = Panel(explaintree_th)
panel_9 = Panel(explaintree)
# Andrei Nejur | pythonListtoTree.gh
# 
# https://www.grasshopper3d.com/forum/topics/datatreelistitem-access-from?id=2985220%3ATopic%3A239217&page=3#comments
python = PythonScript()  # -> out, a
# ---------- python: Python ----------
list = [1,[2,3],[1,[10,11,12],3],[1,2,3],[1,2,3]]
print list
a = list
# ---------- end python ----------
panel_10 = Panel(python.out)
pylist2tree = PythonListToGHTree(list=python.a)  # -> out, tree_out; inputs list: list
# ---------- pylist2tree: Python ----------
import collections
from Grasshopper import DataTree
from Grasshopper.Kernel.Data import GH_Path
from Grasshopper.Kernel import GH_Author

ghenv.Component.Name = 'python list to GH tree'
ghenv.Component.NickName = 'pyList2Tree'



"""
Python List to Grasshopper Tree - Component
by Andrei Nejur 

takes a nested python list an outputs the corespnding GH Tree with
each list element on its coresponding branch. Works with as many nested 
levels as needed.
Just plug the nested python list in the list input. 
Out prints a list of the created tree branches .


Use it for whatever you need 
"""


def unpackList(lst, path=GH_Path(0)):
    tree = DataTree[object]()
    
    for elem in lst:
        
        if isinstance(elem, collections.Iterable):
            tree.MergeTree(unpackList(elem,path.AppendElement(0)))
        else:
            print(path)
            tree.Add(elem,path)
        path = path.Increment(-1)
       
    return tree



tree_out = unpackList(list)
# ---------- end pylist2tree ----------
viewer = ParamViewer(pylist2tree.tree_out)
panel_11 = Panel(pylist2tree.out)
python_2 = PythonScript()  # -> out, a
# ---------- python_2: Python ----------
import collections
try:
    from Grasshopper import DataTree
    from Grasshopper.Kernel.Data import GH_Path
except:
    pass

def NestedListToGrasshopperDataTree (nstdDtaLst, path_Init = GH_Path(0)):
    def _UnpackList (_nstdDtaLst, _path):
        _dtaTr = DataTree[object]()
        for _dtaElem in _nstdDtaLst:
            if isinstance(_dtaElem, collections.Iterable):
                _dtaTr.MergeTree(_UnpackList(_dtaElem, _path.AppendElement(0)))
            else:
                _dtaTr.Add(_dtaElem, _path)
            _path = _path.Increment(-1) #+1 would increment one-level up instead
        return _dtaTr;
        
    return _UnpackList (nstdDtaLst, path_Init);

_list=[1,[1,2],[2,3],3,4]
_tree=NestedListToGrasshopperDataTree(_list)
a=_tree
# ---------- end python_2 ----------
panel_12 = Panel(pylist2tree.tree_out)
panel_13 = Panel(python_2.a)
