# Grasshopper definition potentialexcercises.gh (Grasshopper 0.9.76)
# plug-ins: Python Interpreter

rectangle = Rectangle(Plane=PlaneXY(0, 0, 0), XSize="-5 to 5", YSize="-5 to 5", Radius=0)  # -> Rectangle, Length
populate_2d = Populate2D(Region=rectangle.Rectangle, Count=100, Seed=1)
point = Point("0,0,0")
python_script = PythonScript(RGPtsL=populate_2d, RGBasePt=point)  # -> out, RGPtsL_New; inputs RGPtsL: list of Point3d, RGBasePt: Point3d
# ---------- python_script: Python ----------
import Rhino.Geometry as RG

def calcFac (dist, deg=2):
    if dist == 0:
        fac = 1
    else:
        fac = 1/ dist ** deg
    return min(1,fac);
    
RGPtsL_New = []
for _RGPt in RGPtsL:
    _dist   = RG.Point3d.DistanceTo(_RGPt, RGBasePt)
    _ptDiff = RG.Point3d.Subtract(RGBasePt,_RGPt)
    _vecX, _vecY, _vecZ = _ptDiff.X, _ptDiff.Y, _ptDiff.Z
    _vec    = RG.Vector3d(_vecX, _vecY, _vecZ)
#    _vec.Unitize()
    _fac    = calcFac(_dist)
    _vec    = RG.Vector3d.Multiply(_vec,_fac)
    _ptNew  = RG.Point3d.Add(_RGPt,_vec)
    RGPtsL_New.append(_ptNew)
# ---------- end python_script ----------
line = Line(StartPoint=populate_2d, EndPoint=python_script.RGPtsL_New)
python_script_2 = PythonScript()  # -> out, guid
# ---------- python_script_2: Python ----------
from compas_pattern.cad.rhino.utilities import draw_mesh

guid = draw_mesh(quad_mesh_datastructure, group = False)
# ---------- end python_script_2 ----------
